# Grasshopper definition 20181229_WIPFullMockup.gh (Grasshopper 0.9.76)
# plug-ins: Python Interpreter, Kangaroo2 Components

# ---- group: Proxy Reset
python_script = PythonScript()
# ---------- python_script: Python ----------
from compas.rpc import Proxy
compas = Proxy()
compas.try_reconnect()
#compas = Proxy()
# ---------- end python_script ----------

# ----
python = PythonScript()  # -> out, formDiag, RGMesh
# ---------- python: Python ----------
from compas_ghc.DataStructures.CGHDiagrams import CGHFormDiagram

formDiag    = CGHFormDiagram.from_json('C:/Users/Kam-Ming Mark Tam/Documents/GitHub/AAG2018/AAG2018/src/day_1/final/aag_02_formdiagram.json')
RGMesh      = formDiag.ToRGMesh()
# ---------- end python ----------
mesh = Mesh(python.RGMesh)
rectangle = Rectangle(Plane=PlaneXY(0, 0, 0), XSize="-5 to 5", YSize="-5 to 5", Radius=0)  # -> Rectangle, Length
mesh_surface = MeshSurface(Surface=rectangle.Rectangle, UCount=5, VCount=5, Overhang=True, Equalize=False)
mesh_2 = Mesh(mesh_surface)
deconstruct_mesh = DeconstructMesh(Mesh=mesh_2)  # -> Vertices, Faces, Colours, Normals
construct_point = ConstructPoint(XCoordinate=0, YCoordinate=0, ZCoordinate=Slider(0.1, range=0..1))
cluster = Cluster(mesh=mesh_2)
meshcorners = MeshCorners(Mesh=mesh_2, Angle=2.35619449)
createloads = CreateLoads(loaded_point_s=deconstruct_mesh.Vertices)
createloads_2 = CreateLoads(load_vector_s=construct_point)
cluster_2 = Cluster_2(element_type="e", attribute_name="q", attribute_values="-2")
point = Point(meshcorners)
data = Data(flatten([createloads, createloads_2]))
cluster_3 = Cluster_14(formdiagram=cluster, elements_modifications_instructions=cluster_2)
cluster_4 = Cluster_6(formdiagram=cluster, anchor_points=point, loads=data, elements_modifications_instructions=cluster_2)
data_2 = Data(cluster_4)
cluster_5 = Cluster_7(formdiagram=data_2)
cluster_6 = Cluster_11(structural_design=cluster_5, element_type="e", attributes_names="a")  # -> attributes_names_2, attributes_values
panel = Panel(cluster_6.attributes_values)
cluster_7 = Cluster_3(diagram=cluster_4)
data_3 = Data(cluster_5)
data_4 = Data(data_3)
forcedensitysolver = ForceDensitySolver(structuraldesign_⓿=data_4)  # -> structuraldesign_➊, forcediagram_➊, forces_➊, lengths_➊, forcedensities_➊_2, forcedensities_➊, residual_forces_➊
cluster_8 = Cluster_11(structural_design=forcedensitysolver.structuraldesign_➊, element_type="e", attributes_names="q")  # -> attributes_names_2, attributes_values
panel_2 = Panel(cluster_8.attributes_values)
data_5 = Data(forcedensitysolver.forcediagram_➊)
python_2 = PythonScript(x=data_5)  # -> out, a, b, eKey1, eKey2
# ---------- python_2: Python ----------
a = x.EdgeKeys(bool_ExclExt=True)
b=x.VerticesOnBoundary()


eKey1 = x.EdgeKeys(bool_ExclExt=False, bool_Ind=True)
eKey2 = x.EdgeKeys(bool_ExclExt=False, bool_Ind=False)
for _eKey in eKey2:
    print eKey1.index(_eKey)
# ---------- end python_2 ----------
panel_3 = Panel(python_2.eKey2)
panel_4 = Panel(python_2.eKey1)
data_6 = Data(forcedensitysolver.forcediagram_➊)
cluster_9 = Cluster_13(formdiag=data_5)  # -> pts, edgekeys, faceverticeskeys
cluster_10 = Cluster_12(formdiag=data_6)  # -> pts, edges_asendpts, edges_aslines, faces_asendpts, faces_aspolylines
mesh_3 = Mesh(cluster_7)
cluster_11 = Cluster_8(structuraldesign_⓿=data_3)  # -> structuraldesign_1, forcediagram_1
cluster_12 = Cluster_11(structural_design=forcedensitysolver.structuraldesign_➊, element_type="e", attributes_names="f")  # -> attributes_names_2, attributes_values
item = ListItem(List=cluster_12.attributes_values, Index=0, Wrap=True)  # -> Item1, flatten(Item)
python_3 = PythonScript(x=item.Item1)  # -> simplify(flatten(a))
# ---------- python_3: Python ----------
a=x
# ---------- end python_3 ----------
number_slider = Slider(90, range=0..100)  # disabled
number_slider_2 = Slider(100, range=0..100)  # disabled
data_7 = Data(cluster_11.structuraldesign_1)  # disabled
α = Alpha(number_slider)  # disabled
kmax = MaxIterations(number_slider_2)  # disabled
cluster_13 = Cluster_3(diagram=forcedensitysolver.forcediagram_➊)
cluster_14 = Cluster_9(structuraldesign_⓿=data_7, alpha=α, maxiterations=kmax)  # -> structuraldesign_➊, formdiagram_➊, forcediagram_➊, log; disabled
data_8 = Data(forcedensitysolver.forcediagram_➊)
cluster_15 = Cluster_4()  # -> structuraldesign_1, forcediagram_1; disabled

# ---- group: Visualiser
cluster_16 = Cluster_16(data=data_8)

# ----
number_slider_3 = Slider(100, range=0..100)  # disabled
number_slider_4 = Slider(5, range=0..10)  # disabled
data_9 = Data(cluster_14.formdiagram_➊)  # disabled
data_10 = Data(cluster_14.forcediagram_➊)  # disabled
structdsg_⓿ = StructuralDesign⓿(cluster_14.structuraldesign_➊)  # disabled
data_11 = Data(number_slider_3)  # disabled
data_12 = Data(number_slider_4)  # disabled
mesh_4 = Mesh(cluster_13)
mesh_edges = MeshEdges(Mesh=mesh_4)  # -> NakedEdges, InteriorEdges, NonManifoldEdges; disabled
cluster_17 = Cluster_10(structuraldesign_⓿=structdsg_⓿, maxiterations=data_11, maxheight=data_12)  # -> structuraldesign_➊, formdiagram_➊; disabled
data_13 = Data(python_3)
merge = Merge(Data1=mesh_edges.NakedEdges, Data2=mesh_edges.InteriorEdges)  # disabled
abs = Absolute(Value=data_13)
python_script_2 = PythonScript()  # -> out, guid; disabled
# ---------- python_script_2: Python ----------
from compas_pattern.cad.rhino.utilities import draw_mesh

guid = draw_mesh(quad_mesh_datastructure, group = False)
# ---------- end python_script_2 ----------
python_script_3 = PythonScript()  # -> out; disabled
# ---------- python_script_3: Python ----------
#print (globals())

for _k, _attr in globals().items():
    print (_k)
# ---------- end python_script_3 ----------
data_14 = Data(cluster_17.formdiagram_➊)  # disabled
python_script_4 = PythonScript()  # -> out, a
# ---------- python_script_4: Python ----------
class testCls():
    def __init__(self):
        self.a = 1
    
    def dp(self):
        new = self.__class__()
        return new
        
test = testCls()
test2 = test.dp()

print (test.a)
print (test2.a)
# ---------- end python_script_4 ----------
data_15 = Data(abs)
cluster_18 = Cluster_3(diagram=data_14)  # disabled
sort = SortList(Keys=data_15)  # -> reverse(Keys), ValuesA
mesh_5 = Mesh(cluster_18)  # disabled
item_2 = ListItem(List=sort.Keys, Index=0, Wrap=True)  # -> Item1, Item

# ==== cluster Cluster
mesh = ClusterInput()
data = Data(mesh)
python_script = PythonScript(RGMesh=data)  # -> out, CGHDiag; inputs RGMesh: Mesh
# ---------- python_script: Python ----------
from compas_ghc.DataStructures.CommonMethods import ElementsMappings
from compas_ghc.DataStructures.CommonMethods import ElementsIdentifiers
from compas_ghc.DataStructures.CommonMethods import ElementsRetrival
from compas_ghc.DataStructures.CommonMethods import RGMeshConversion 
from compas_ghc.Utilities import RCGeometriesDrawers
reload(RGMeshConversion )
reload(ElementsMappings)
reload(ElementsIdentifiers)
reload(ElementsRetrival)
reload(RCGeometriesDrawers)

from compas_ghc.DataStructures import CGHDataTypesBase
reload(CGHDataTypesBase)              
from compas_ghc.DataStructures import CGHDiagrams    
reload(CGHDiagrams)              

from compas_ghc.Utilities.InputsOutputsProcessing           import GrasshopperInputsGate
if GrasshopperInputsGate(RGMesh, 'Mesh'):
    from compas_ghc.DataStructures.CGHDiagrams                  import CGHDiagram
    _RGMesh         = RGMesh
    _CGHDiag        = CGHDiagram.FromRGMesh(_RGMesh)
    CGHDiag = _CGHDiag
# ---------- end python_script ----------
data_2 = Data(python_script.CGHDiag)
panel = Panel(data_2)
diagram = ClusterOutput(data_2)

# ==== cluster CreateLoads
load_vector_s = ClusterInput()
loaded_point_s = ClusterInput()
vec = Vector(load_vector_s)
pt = Point(loaded_point_s)
vec_2 = Vector("0,0,-1")
python = PythonScript(rgPtsL=pt, rgVecsL=vec, rgVec_DfltLd=vec_2)  # -> out, structLdsL; inputs rgPtsL: list of Point3d, rgVecsL: list of Vector3d, rgVec_DfltLd: Vector3d
# ---------- python: Python ----------
from compas_ghc.DataStructures import CGHStructuralLoad
reload (CGHStructuralLoad)
from compas_ghc.Utilities.InputsOutputsProcessing import GrasshopperInputsGate
from compas_ghc.Utilities.InputsOutputsProcessing import SetDefaultInput as SetDfltInp
from compas_ghc.Utilities.InputsOutputsProcessing import MatchListsLengths as MatchLstLgths
from compas_ghc.DataStructures.CGHStructuralLoad  import CGHStructuralLoad as CGHStructLd

#Process inputs and match lists
_rgPtsL = rgPtsL
_rgVecsL = SetDfltInp(rgVecsL, rgVec_DfltLd, bool_LstOtp = True)

_len_Pts = len(_rgPtsL)
_len_Vecs = len(_rgVecsL)
_structLdsL = []

if _len_Pts == 0 and _len_Vecs>0:
    for __vec in _rgVecsL:
        __structLd  = CGHStructLd(vec_LdDirMag=__vec) #Total gravity
        _structLdsL.append(__structLd)

elif _len_Pts > 0:
    _rgVecsL = MatchLstLgths(_rgPtsL, _rgVecsL)
    _zipLdsInfo = zip(_rgPtsL, _rgVecsL)
    if _len_Pts > 0 or _len_Vecs > 0: 
        
        for __rgPt, __rgVec in _zipLdsInfo:
            print (__rgPt, __rgVec)
            __coords    = [__rgPt.X, __rgPt.Y, __rgPt.Z]
            __vec       = [__rgVec.X, __rgVec.Y, __rgVec.Z]
            __structLd  = CGHStructLd(__coords, __vec)
            _structLdsL.append(__structLd)

structLdsL = _structLdsL
# ---------- end python ----------
data = Data(python.structLdsL)
cghloads = ClusterOutput(data)

# ==== cluster Cluster_2
list_of_elements_keys = ClusterInput()  # If no keys are entered, the attribute value will apply to all elements.
attribute_values = ClusterInput()  # Enter one value to be applied to all elements keyed, or enter one value per element keyed.
element_type = ClusterInput()  # 'v': vertex, 'e': edge
attribute_name = ClusterInput()  # Input single string/text entry.
data = Data(attribute_values)
data_2 = Data(list_of_elements_keys)
data_3 = Data(element_type)
data_4 = Data(attribute_name)
python = PythonScript(char_ElemsTyp=data_3, strsL_AttrNm=data_4, keysL_Elems=data_2, dtaL_AttrVals=data)  # -> out, instsElemsAttrsModL; inputs strsL_AttrNm: list, keysL_Elems: list, dtaL_AttrVals: list
# ---------- python: Python ----------
from compas_ghc.DesignSpecification import InstructionsContainer  as _InstructionsContainer 
reload(_InstructionsContainer)
from compas_ghc.Utilities.InputsOutputsProcessing import MatchListsLengths as MatchLstLgths
from compas_ghc.Utilities.InputsOutputsProcessing import GrasshopperInputsGate
from compas_ghc.Utilities.InputsOutputsProcessing import SetDefaultInput as SetDfltInp

from compas_ghc.DesignSpecification.InstructionsContainer import ElementsAttributesModificationInstructions as ElemsAttrsModInsts

_char_ElemsTyp = char_ElemsTyp
if GrasshopperInputsGate(_char_ElemsTyp, 'str'):
    _strsL_AttrNm       = list(strsL_AttrNm)
    _keysL_Elems        = list(keysL_Elems)
    _dtaL_AttrVals      = list(dtaL_AttrVals)
    
    _len_AttrNms        = len(_strsL_AttrNm)
    _len_Elems          = len(_keysL_Elems)
    _len_AttrVals       = len(dtaL_AttrVals)
    
    _bool_NmValMtch     = _len_AttrNms == _len_AttrVals
    _bool_AllLgthsMtch  = _len_Elems == _len_AttrNms and _bool_NmValMtch
    
    _instsElemsAttrsModL = []
    if _bool_AllLgthsMtch and _len_Elems >= 1:
        _constrMtd = 0
    elif _len_Elems > 1 and _bool_NmValMtch and _len_AttrNms == 1:
        _constrMtd = 1
    elif _len_Elems == 1 and _bool_NmValMtch and _len_AttrNms > 1:
        MatchLstLgths(_strsL_AttrNms, _keysL_Elems)
        _constrMtd = 0
    elif _len_Elems == 0 and _bool_NmValMtch and _len_AttrNms == 1:
        _constrMtd = 2

    if _constrMtd == 0:
       for __key_Elem, __str_AttrNm, __dtaVal in zip(_keysL_Elems, _strsL_AttrNm, dtaL_AttrVals):
            _instsElemsAttrsModL.append(ElemsAttrsModInsts(_char_ElemsTyp, __str_AttrNm, __dtaVal, __key_Elem))
    elif _constrMtd == 1:
       _instsElemsAttrsModL.append(ElemsAttrsModInsts(_char_ElemsTyp, _strsL_AttrNm[0], _dtaL_AttrVals[0], _keysL_Elems))
    elif _constrMtd == 2:
       _instsElemsAttrsModL.append(ElemsAttrsModInsts(_char_ElemsTyp, _strsL_AttrNm[0], _dtaL_AttrVals[0], _keysL_Elems)) 
       
    instsElemsAttrsModL = _instsElemsAttrsModL
# ---------- end python ----------
data_5 = Data(python.instsElemsAttrsModL)
elements_attributes_modification_instruc = ClusterOutput(data_5)

# ==== cluster Cluster_3
diagram = ClusterInput()
data = Data(diagram)
python = PythonScript(cDtaStruct=data)  # -> out, rgMesh
# ---------- python: Python ----------
from compas_ghc.Utilities.InputsOutputsProcessing import GrasshopperInputsGate
from compas_ghc.Utilities.InputsOutputsProcessing import IsCompasDataStructure as IsCpDtaStruct
from compas_ghc.Utilities.InputsOutputsProcessing import SetDefaultInput as SetDfltInp


if IsCpDtaStruct(cDtaStruct):
    _cDtaStruct = cDtaStruct.CreateDuplicate()
    _rgMesh = _cDtaStruct.ToRGMesh()
    rgMesh = _rgMesh
# ---------- end python ----------
data_2 = Data(python.rgMesh)
mesh = ClusterOutput(data_2)

# ==== cluster Cluster_4
structuraldesign_0 = ClusterInput()
createdualdiagram = PythonScript(structDsg_0=structuraldesign_0)  # -> formDiag, forceDiag
# ---------- createdualdiagram: Python ----------
from compas_ghc.Utilities.InputsOutputsProcessing import GrasshopperInputsGate

if GrasshopperInputsGate(structDsg_0, 'CGHStructuralDesign'):
    _structDsg_0    = structDsg_0
    
    _formDiag       = _structDsg_0.formDiag
    _forceDiag      = _structDsg_0.forceDiag
    
    formDiag        = _formDiag
    forceDiag       = _forceDiag
# ---------- end createdualdiagram ----------
structuraldesign_1 = ClusterOutput(createdualdiagram.formDiag)
forcediagram_1 = ClusterOutput(createdualdiagram.forceDiag)

# ==== cluster Cluster_6
formdiagram = ClusterInput()
loads = ClusterInput()
elements_modifications_instructions = ClusterInput()
anchor_points = ClusterInput()
data = Data(elements_modifications_instructions)
data_2 = Data(loads)
data_3 = Data(formdiagram)
data_4 = Data(anchor_points)
data_5 = Data(data_2)
python = PythonScript(inp_Dta=data_3)  # -> formDiag, str_InpTyp, strCoordsL
# ---------- python: Python ----------
from compas_ghc.DataStructures.CGHDiagrams import CGHFormDiagram
if inp_Dta is not None:
    from copy import deepcopy
    _inp_Dta = deepcopy(inp_Dta)
    
    _formDiag = None
    _str_ClsNm = _inp_Dta.__class__.__name__
    
    if (_str_ClsNm == 'Guid'):
        from compas_rhino.geometry import RhinoMesh
        _formDiag = CGHFormDiagram.from_vertices_and_faces(*(RhinoMesh.from_guid(_inp_Dta).get_vertices_and_faces()))
        str_InpTyp = 'GUID'
    elif (_str_ClsNm == 'Mesh' or _str_ClsNm == 'CGHDiagram'):
        _formDiag = CGHFormDiagram.from_data(_inp_Dta.to_data())
        str_InpTyp = 'cDtaStruct'
    elif (_str_ClsNm == 'CGHFormDiagram'):
        _formDiag = _inp_Dta
        str_InpTyp = 'CGHFormDiagram'
        
    formDiag = _formDiag
    
if formDiag is not None:
    coordsL = [formDiag.vertex_coordinates(_vKey) for _vKey in formDiag.vertex.keys()]
    strCoordsL = []
    [strCoordsL.append('{'+str(_coords[0])+','+str(_coords[1])+','+str(_coords[2])+'}') for _coords in coordsL]
# ---------- end python ----------
python_2 = PythonScript(structLdsL=data_5)  # -> out, strCoordsL_LdsPos, vecsLw_ApldLdsDirMag, vecsLw_GblLdsDirMag; inputs structLdsL: list
# ---------- python_2: Python ----------
from copy import deepcopy
_structLdsL = deepcopy(structLdsL)
_strCoordsL_LdsPos = []
_vecsL_ApldLdsDirMag = [] 
_vecsL_GblLdsDirMag = []

for _structLd in _structLdsL:
    if not _structLd.IsGlobalLoad():
        _coords = _structLd.coords
        _vec    = _structLd.vec
        _strCoordsL_LdsPos.append('{'+str(_coords[0])+','+str(_coords[1])+','+str(_coords[2])+'}')
        _vecsL_ApldLdsDirMag.append(_vec)
    else:
        _vecsL_GblLdsDirMag.append(_structLd.vec)

vecsLw_ApldLdsDirMag = [_vecsL_ApldLdsDirMag] #to address GH's output processing when only one load is supplied
vecsLw_GblLdsDirMag = [_vecsL_GblLdsDirMag]
strCoordsL_LdsPos = _strCoordsL_LdsPos
# ---------- end python_2 ----------

# ---- group: !MvToCode
trim = TrimTree(Tree=python.strCoordsL, Depth=1)

# ----
data_6 = Data(python.formDiag)
pt = Point(trim)
pt_2 = Point(python_2.strCoordsL_LdsPos)
data_7 = Data(python_2.vecsLw_GblLdsDirMag)
data_8 = Data(python_2.vecsLw_ApldLdsDirMag)
pt_3 = Point(pt)
pt_4 = Point(pt)
data_9 = Data(data_4)
data_10 = Data(pt_2)
cluster = Cluster_5(data=data_10, pt=pt_4)
cluster_2 = Cluster_5(data=data_9, pt=pt_3)
data_11 = Data(data_6)
int = Integer(cluster_2)
int_2 = Integer(cluster)
data_12 = Data(data_11)
int_3 = Integer(int)
data_13 = Data(data_7)
data_14 = Data(data_8)
data_15 = Data(data)
data_16 = Data(int_2)
python_3 = PythonScript(
    formDiag_0=data_12,
    vKeysL_Anchs=int_3,
    vKeysL_LdsPos=data_16,
    vecsLw_LdsDirMag=data_14,
    vecsLw_GblLdsDirMag=data_13,
    instsElemsAttrsModL=data_15)  # -> out, formDiag_1; inputs vKeysL_Anchs: list, vKeysL_LdsPos: list, vecsLw_LdsDirMag: list, vecsLw_GblLdsDirMag: list, instsElemsAttrsModL: list
# ---------- python_3: Python ----------
from compas_ghc.Utilities.InputsOutputsProcessing import GrasshopperInputsGate
from compas_ghc.DesignSpecification import FormDiagramModifications 
reload(FormDiagramModifications)

if GrasshopperInputsGate(formDiag_0, 'CGHFormDiagram'):
    from copy import deepcopy
    _formDiag_1 = formDiag_0.CreateDuplicate()
    
    _vKeysL_Anchs = deepcopy(vKeysL_Anchs)
    _vKeysL_LdsPos = deepcopy(vKeysL_LdsPos)
    _vecsL_LdsDirMag = deepcopy(vecsLw_LdsDirMag[0])
    _vecsL_GblLdsDirMag = deepcopy(vecsLw_GblLdsDirMag[0])
    _instsElemsAttrsModL = deepcopy(instsElemsAttrsModL)
    
    from compas_ghc.Utilities.InputsOutputsProcessing import SetDefaultInput as SetDfltInp
    from compas_ghc.DataStructures.CGHStructuralDesign import CGHStructuralDesign as StructDsg
    from compas_ghc.DesignSpecification.FormDiagramModifications import ImplementElementsModifications as ImplElemsMods
    
    if len(_vKeysL_Anchs) > 0:
        _formDiag_1.set_vertices_attribute('is_anchor', True, _vKeysL_Anchs)
        _formDiag_1.update_boundaries()
        
    if len(_vKeysL_LdsPos) > 0:
        zipLdsInfo = zip(_vKeysL_LdsPos, _vecsL_LdsDirMag)
        for __vKey_LdPos, __vec_LdDirMag in zipLdsInfo:
            _formDiag_1.set_vertex_attributes(__vKey_LdPos, ['px','py','pz'],__vec_LdDirMag)
            
    if len(_vecsL_GblLdsDirMag) > 0:
        if not hasattr(_formDiag_1,'vec_GblArLd'):
            setattr(_formDiag_1,'vec_GblArLd',[0,0,0])
        for __vec in _vecsL_GblLdsDirMag:
            _formDiag_1.vec_GblArLd = [_cnpt_DiagCurr + _cnpt_Imp for _cnpt_DiagCurr, _cnpt_Imp in zip(_formDiag_1.vec_GblArLd, __vec)]
        

    if len (_instsElemsAttrsModL) > 0 and _instsElemsAttrsModL[0] is not None:
        ImplElemsMods(_formDiag_1, _instsElemsAttrsModL)

    formDiag_1 = _formDiag_1
    
    

#for _vKey, _attr in formDiag_1.vertex.items():
#    print (_vKey, _attr)
# ---------- end python_3 ----------
data_17 = Data(python_3.formDiag_1)
formdiagram_1 = ClusterOutput(data_17)

# ==== cluster Cluster_7
formdiagram = ClusterInput()
forcediagram = ClusterInput()
data = Data(formdiagram)
data_2 = Data(forcediagram)
python = PythonScript(formDiag=data, forceDiag=data_2)  # -> structDsg
# ---------- python: Python ----------
from compas_ghc.DataStructures import CGHDiagrams
reload(CGHDiagrams)
from compas_ghc.DataStructures import CGHStructuralDesign as _CGHStructDsg
reload(_CGHStructDsg)

from compas_ghc.DataStructures.CGHStructuralDesign import CGHStructuralDesign as StructDsg

#if form or force diagrams are valid?
_structDsg = StructDsg()

if formDiag is not None:
    _structDsg.SetFormDiagram(formDiag.CreateDuplicate())

if forceDiag is not None:
    _structDsg.SetForceDiagram(forceDiag.CreateDuplicate())
    
structDsg = _structDsg
# ---------- end python ----------
data_3 = Data(python)
structuraldesign = ClusterOutput(data_3)

# ==== cluster Cluster_8
structuraldesign_⓿ = ClusterInput()
data = Data(structuraldesign_⓿)
createdualdiagram = PythonScript(structDsg_0=data)  # -> structDsg_1, forceDiag_1
# ---------- createdualdiagram: Python ----------
from compas_ghc.DataStructures import CGHStructuralDesign as _CGHStructDsg
reload(_CGHStructDsg)

from compas_ghc.DataStructures.CGHDiagrams import CGHForceDiagram 
from compas_ghc.DataStructures.CGHStructuralDesign import CGHStructuralDesign as CGHStructDsg
if structDsg_0 is not None:
    _structDsg_1        = structDsg_0.CreateDuplicate()
    _formDiag_1         = _structDsg_1.formDiag
    _forceDiag_1        = CGHForceDiagram.from_formdiagram(_formDiag_1)
    _structDsg_1.SetForceDiagram(_forceDiag_1)

    structDsg_1 = _structDsg_1
    forceDiag_1 = _forceDiag_1
# ---------- end createdualdiagram ----------
data_2 = Data(createdualdiagram.forceDiag_1)
data_3 = Data(createdualdiagram.structDsg_1)
structuraldesign_1 = ClusterOutput(data_3)
forcediagram_1 = ClusterOutput(data_2)

# ==== cluster Cluster_9
structuraldesign_⓿ = ClusterInput()
alpha = ClusterInput()  # default: 100
maxiterations = ClusterInput()  # default: 100
data = Data(alpha)
data_2 = Data(maxiterations)
data_3 = Data(structuraldesign_⓿)
python = PythonScript(structDsg_0=data_3, flt_Alpha=data, int_KMax=data_2)  # -> out, structDsg_1, formDiag_1, forceDiag_1; inputs int_KMax: Int32
# ---------- python: Python ----------
from compas_ghc.Utilities.InputsOutputsProcessing import GrasshopperInputsGate

if GrasshopperInputsGate(structDsg_0, 'CGHStructuralDesign'):
    _structDsg_0 = structDsg_0.CreateDuplicate()
    
    from compas.rpc import Proxy
    _TNA = Proxy('compas_ghc.StructuralSolvers.TNA.Equilibrium')

    from compas_ghc.Utilities.InputsOutputsProcessing import SetDefaultInput as SetDfltInp
    from compas_ghc.DataStructures.CGHStructuralDesign import CGHStructuralDesign as StructDsg

    from compas_ghc.DataStructures.CGHDiagrams import CGHFormDiagram as FormDiagram
    from compas_ghc.DataStructures.CGHDiagrams import CGHForceDiagram as ForceDiagram
    
    _formDiag_0, _forceDiag_0 = _structDsg_0.OutputDualDiagrams()
    
    _flt_Alpha = SetDfltInp(flt_Alpha, 100)
    _int_KMax = SetDfltInp(int_KMax, 100)

    _formData_0 = _formDiag_0.to_data()
    _forceData_0 = _forceDiag_0.to_data()
    
    try:
        _formData_1, _forceData_1 = _TNA.HorizontalEquilibrium_fromData(_formData_0 , _forceData_0, alpha=_flt_Alpha, kmax=_int_KMax)
        try:
            _formDiag_1     = FormDiagram.from_data(_formData_1)
            _forceDiag_1    = ForceDiagram.from_data(_forceData_1)
        
            _structDsg_1    = StructDsg()
            _structDsg_1.SetDualDiagrams(_formDiag_1, _forceDiag_1)
            
            formDiag_1      = _formDiag_1
            forceDiag_1     = _forceDiag_1
            structDsg_1     = _structDsg_1
        except:
            pass
    except:
        pass
# ---------- end python ----------
data_4 = Data(python.structDsg_1)
data_5 = Data(python.forceDiag_1)
data_6 = Data(python.formDiag_1)
data_7 = Data()
formdiagram_➊ = ClusterOutput(data_6)
log = ClusterOutput(data_7)
structuraldesign_➊ = ClusterOutput(data_4)
forcediagram_➊ = ClusterOutput(data_5)

# ==== cluster Cluster_10
structuraldesign_⓿ = ClusterInput()
maxheight = ClusterInput()
maxiterations = ClusterInput()
data = Data(maxiterations)
data_2 = Data(maxheight)
data_3 = Data(structuraldesign_⓿)
python = PythonScript(structDsg_0=data_3, int_KMax=data, flt_ZMax=data_2)  # -> out, structDsg_1, formDiag_1; inputs int_KMax: Int32
# ---------- python: Python ----------
from compas_ghc.Utilities.InputsOutputsProcessing import GrasshopperInputsGate

if GrasshopperInputsGate(structDsg_0, 'CGHStructuralDesign'):
    from compas.rpc import Proxy
    _TNA = Proxy('compas_ghc.StructuralSolvers.TNA.Equilibrium')
   
    _structDsg_0 = structDsg_0.CreateDuplicate()
    
    from compas_ghc.DataStructures.CGHDiagrams import CGHFormDiagram
    from compas_ghc.Utilities.InputsOutputsProcessing import SetDefaultInput as SetDfltInp
    from compas_ghc.DataStructures.CGHStructuralDesign import CGHStructuralDesign as CGHStructDsg
    
    _formDiag_0, _forceDiag_0 = _structDsg_0.OutputDualDiagrams()
    
    
    _int_KMax       = SetDfltInp(int_KMax, 100)
    _flt_ZMax       = SetDfltInp(flt_ZMax, 5)
    _flt_GblArLd    = _structDsg_0.vec_GblArLd[2]

    _formData_0 = _formDiag_0.to_data()
    
    try:
        _formData_1, _scale = _TNA.VerticalEquilibrium_fromZMax_fromData(_formData_0, zmax = _flt_ZMax, kmax = _int_KMax, density = _flt_GblArLd)
        
        try:
            _formDiag_1     = CGHFormDiagram.from_data(_formData_1)
            _forceDiag_1    = _forceDiag_0.CreateDuplicate()
            _structDsg_1    = CGHStructDsg()
            _structDsg_1.SetDualDiagrams(_formDiag_1, _forceDiag_1)
            
            formDiag_1      = _formDiag_1
            structDsg_1     = _structDsg_1
        except:
            pass
        
    except:
        pass
# ---------- end python ----------
data_4 = Data(python.structDsg_1)
data_5 = Data(python.formDiag_1)
formdiagram_➊ = ClusterOutput(data_5)
structuraldesign_➊ = ClusterOutput(data_4)

# ==== cluster ForceDensitySolver
structuraldesign_⓿ = ClusterInput()
data = Data(structuraldesign_⓿)
python = PythonScript(structDsg_0=data)  # -> out, structDsg_1, formDiag_1, fltsL_Fcs, fltsL_Lgths, fltsL_Qs, fltsL_Lds, fltsL_ResidFcs, strsL_ErrMsgs
# ---------- python: Python ----------
from compas_ghc.Utilities.InputsOutputsProcessing       import GrasshopperInputsGate
from compas_ghc.Utilities.InputsOutputsProcessing       import SetDefaultInput as SetDfltInp
from compas_ghc.DataStructures.CGHStructuralDesign      import CGHStructuralDesign as CGHStructDsg
from compas_ghc.Utilities.PythonGrasshopperIterables    import NestedListToGrasshopperDataTree as NstdLstToGHDtaTr

if GrasshopperInputsGate(structDsg_0, 'CGHStructuralDesign'):
    from compas.rpc import Proxy
    _FDM = Proxy('compas_ghc.StructuralSolvers.FDM.FDM')
#    _FDM.stop_server()
#    _FDM = Proxy('compas_ghc.StructuralSolvers.FDM.FDM')
    
    from compas_ghc.DataStructures.CGHDiagrams import CGHFormDiagram
    
    _structDsg_0 = structDsg_0.CreateDuplicate()
    _formDiag = structDsg_0.formDiag
    
    _flt_TtlSWLd = -1 * structDsg_0.vec_GblArLd[2]
    _structDsg_1 = CGHStructDsg()
   
    _formData_0 = structDsg_0.formDiag.to_data()
    _formData_1, _cDctStructSolvOprDta= _FDM.ForceDensitySolver(_formData_0, _flt_TtlSWLd, bool_LdsRdistrByTrib = True, iMax_LdsRedistr = 5)
    _formDiag_1 = CGHFormDiagram.from_data(_formData_1)
    _structDsg_0.SetFormDiagram(_formDiag_1)
    
    formDiag_1  = _formDiag_1
    structDsg_1 = _structDsg_0
    
    _eKeysL = formDiag_1.EdgeKeys()
    _vKeysL = formDiag_1.VertexKeys()
    _structSolvEdgeDta = formDiag_1.get_edges_attributes(names=['f','l','q'], keys=_eKeysL)
    _structSolvVertexDta = formDiag_1.get_vertices_attributes(names=['fResid','p'], keys=_vKeysL)
    
    fltsL_Fcs, fltsL_Lgths, fltsL_Qs = [[_structSolvEdgeDta[_v][_iAttr] for _v in range(0, len(_eKeysL))] for _iAttr in range(0,3)]
    fltsL_ResidFcs, fltsL_Lds = [[_structSolvVertexDta[_v][_iAttr] for _v in range(0, len(_vKeysL))] for _iAttr in range(0,2)]
    fltsL_Lds = NstdLstToGHDtaTr(fltsL_Lds)
#    print _cDctStructSolvOprDta['res']['all']['0']['lds']
# ---------- end python ----------
trim = TrimTree(Tree=python.fltsL_Lds, Depth=1)
data_2 = Data(python.structDsg_1)
data_3 = Data(python.fltsL_Fcs)
data_4 = Data(python.fltsL_Lgths)
data_5 = Data(python.formDiag_1)
data_6 = Data(python.fltsL_ResidFcs)
data_7 = Data(python.fltsL_Qs)
data_8 = Data(trim)
structuraldesign_➊ = ClusterOutput(data_2)
lengths_➊ = ClusterOutput(data_4)
forcedensities_➊ = ClusterOutput(data_8)
residual_forces_➊ = ClusterOutput(data_6)
forcediagram_➊ = ClusterOutput(data_5)
forces_➊ = ClusterOutput(data_3)
forcedensities_➊_2 = ClusterOutput(data_7)

# ==== cluster Cluster_11
structural_design = ClusterInput()
element_type = ClusterInput()
attributes_names = ClusterInput()
data = Data(attributes_names)
data_2 = Data(structural_design)
data_3 = Data(element_type)
python_script = PythonScript(structDsg=data_2, char_ElemTyp=data_3, str_FltrByAttrName=data)  # -> out, GHDtaTr_Lgds, GHDtaTr_Vals
# ---------- python_script: Python ----------
from compas_ghc.ResultsExtraction import ExtractElementsData
reload (ExtractElementsData)

from compas_ghc.Utilities.InputsOutputsProcessing import GrasshopperInputsGate
from compas_ghc.Utilities.InputsOutputsProcessing import SetDefaultInput as SetDfltInp
from compas_ghc.DataStructures.CGHStructuralDesign import CGHStructuralDesign as CGHStructDsg
from compas_ghc.ResultsExtraction.ExtractElementsData import ExtractElementsData

if GrasshopperInputsGate(structDsg, 'CGHStructuralDesign'):
    _char_ElemTyp           = SetDfltInp(char_ElemTyp, 'e')
    _str_FltrByAttrName     = SetDfltInp(str_FltrByAttrName, None)
    _GHDtaTr_Lgds, _GHDtaTr_Vals = ExtractElementsData(structDsg.formDiag, _char_ElemTyp, _str_FltrByAttrName)
    
GHDtaTr_Lgds    = _GHDtaTr_Lgds
GHDtaTr_Vals    = _GHDtaTr_Vals
# ---------- end python_script ----------
data_4 = Data(python_script.GHDtaTr_Lgds)
data_5 = Data(python_script.GHDtaTr_Vals)
attributes_names_2 = ClusterOutput(data_4)
attributes_values = ClusterOutput(data_5)
panel = Panel(python_script.GHDtaTr_Vals)

# ==== cluster Cluster_12

# ---- group: Deconstruct Geometry
formdiag = ClusterInput()

# ----
python = PythonScript(CGHDtaStruct=formdiag)  # -> out, RGPtsL_Vertices, RGPtsPairL_EdgesEndPts, RGLnsL_Edges, RGPtsLL_FacesVertices, RGPtsPllns_FacesOtlns
# ---------- python: Python ----------
from compas_ghc.Utilities.PythonGrasshopperIterables import NestedListToGrasshopperDataTree as NstdLstToGHDtaTr
if CGHDtaStruct is not None:
    print (CGHDtaStruct.__class__.__name__)
    _bool_ExclExt = True if CGHDtaStruct.__class__.__name__ == 'CGHFormDiagram' else False

    _dctVerticesDta = CGHDtaStruct.RetrieveFullVerticesData(    bool_ExclExt=_bool_ExclExt, 
                                                                bool_Keys=True, 
                                                                bool_Ind=True, 
                                                                bool_Coords=True, 
                                                                bool_DrawRG=True)
    _dctEdgesDta = CGHDtaStruct.RetrieveFullEdgesData(          bool_ExclExt=_bool_ExclExt, 
                                                                bool_Key=True, 
                                                                bool_Ind=True, 
                                                                bool_Coords=True, 
                                                                bool_DrawRGPts=True, 
                                                                bool_DrawRGLns=True)
    _dctFacesDta = CGHDtaStruct.RetrieveFullFacesData(          bool_ExclExt=_bool_ExclExt, 
                                                                bool_Key=True, 
                                                                bool_Ind=True, 
                                                                bool_Coords=True, 
                                                                bool_DrawRGPts=True, 
                                                                bool_DrawRGPLns=True, 
                                                                bool_Coords_FaceCnts=False, 
                                                                bool_DrawRGPts_FaceCnts=False)
                                                            
    RGPtsL_Vertices         = _dctVerticesDta['RGs']
    RGPtsPairL_EdgesEndPts  = NstdLstToGHDtaTr(_dctEdgesDta['RGs']['pts'])
    RGLnsL_Edges            = _dctEdgesDta['RGs']['lns']
    RGPtsLL_FacesVertices   = NstdLstToGHDtaTr(_dctFacesDta['RGs']['pts'][0])
    RGPtsPllns_FacesOtlns   = _dctFacesDta['RGs']['plns']
# ---------- end python ----------
trim = TrimTree(Tree=python.RGPtsLL_FacesVertices, Depth=1)
trim_2 = TrimTree(Tree=python.RGPtsPairL_EdgesEndPts, Depth=1)

# ---- group: Deconstruct Geometry (continued)
faces_asendpts = ClusterOutput(trim)
faces_aspolylines = ClusterOutput(python.RGPtsPllns_FacesOtlns)
edges_asendpts = ClusterOutput(trim_2)
pts = ClusterOutput(python.RGPtsL_Vertices)
edges_aslines = ClusterOutput(python.RGLnsL_Edges)

# ==== cluster Cluster_13
formdiag = ClusterInput()
python_script = PythonScript(CGHDtaStruct=formdiag)  # -> out, RGPtsL_Vertices, eKeysIL_Edges, vKeysILL_FaceVertices
# ---------- python_script: Python ----------
from compas_ghc.Utilities.PythonGrasshopperIterables import NestedListToGrasshopperDataTree as NstdLstToGHDtaTr
if CGHDtaStruct is not None:
    print (CGHDtaStruct.__class__.__name__)
    _bool_ExclExt = True if CGHDtaStruct.__class__.__name__ == 'CGHFormDiagram' else False

    _dctVerticesDta = CGHDtaStruct.RetrieveFullVerticesData(    bool_ExclExt=_bool_ExclExt, 
                                                                bool_Keys=True, 
                                                                bool_Ind=True, 
                                                                bool_Coords=True, 
                                                                bool_DrawRG=True)
    _dctEdgesDta = CGHDtaStruct.RetrieveFullEdgesData(          bool_ExclExt=_bool_ExclExt, 
                                                                bool_Key=True, 
                                                                bool_Ind=True, 
                                                                bool_Coords=True, 
                                                                bool_DrawRGPts=True, 
                                                                bool_DrawRGLns=True)
    _dctFacesDta = CGHDtaStruct.RetrieveFullFacesData(          bool_ExclExt=_bool_ExclExt, 
                                                                bool_Key=True, 
                                                                bool_Ind=True, 
                                                                bool_Coords=True, 
                                                                bool_DrawRGPts=True, 
                                                                bool_DrawRGPLns=True, 
                                                                bool_Coords_FaceCnts=False, 
                                                                bool_DrawRGPts_FaceCnts=False)
                                                            
    RGPtsL_Vertices         = _dctVerticesDta['RGs']
    eKeysIL_Edges           = NstdLstToGHDtaTr([list(_eKeyI) for _eKeyI in _dctEdgesDta['inds']])
    vKeysILL_FaceVertices   = NstdLstToGHDtaTr(_dctFacesDta['inds'][1])
# ---------- end python_script ----------
trim_tree = TrimTree(Tree=python_script.eKeysIL_Edges, Depth=1)
trim_tree_2 = TrimTree(Tree=python_script.vKeysILL_FaceVertices, Depth=1)
integer = Integer(trim_tree)
integer_2 = Integer(trim_tree_2)
pts = ClusterOutput(python_script.RGPtsL_Vertices)
faceverticeskeys = ClusterOutput(integer_2)
edgekeys = ClusterOutput(integer)

# ==== cluster Cluster_14
formdiagram = ClusterInput()
elements_modifications_instructions = ClusterInput()
data = Data(elements_modifications_instructions)
data_2 = Data(formdiagram)
python = PythonScript(inp_Dta=data_2)  # -> formDiag, str_InpTyp, strCoordsL; same code as python
data_3 = Data(python.formDiag)
data_4 = Data(data_3)
data_5 = Data(data)
data_6 = Data(data_4)
python_2 = PythonScript(formDiag_0=data_6, instsElemsAttrsModL=data_5)  # -> out, formDiag_1; inputs instsElemsAttrsModL: list
# ---------- python_2: Python ----------
from compas_ghc.Utilities.InputsOutputsProcessing import GrasshopperInputsGate
from compas_ghc.DesignSpecification import FormDiagramModifications 
reload(FormDiagramModifications)

if GrasshopperInputsGate(formDiag_0, 'CGHFormDiagram'):
    from copy import deepcopy
    _formDiag_1 = formDiag_0.CreateDuplicate()
    
    _instsElemsAttrsModL = deepcopy(instsElemsAttrsModL)
    
    from compas_ghc.DesignSpecification.FormDiagramModifications import ImplementElementsModifications as ImplElemsMods
    
    if len (_instsElemsAttrsModL) > 0 and _instsElemsAttrsModL[0] is not None:
        ImplElemsMods(_formDiag_1, _instsElemsAttrsModL)

    formDiag_1 = _formDiag_1
    
    

#for _vKey, _attr in formDiag_1.vertex.items():
#    print (_vKey, _attr)
# ---------- end python_2 ----------
data_7 = Data(python_2.formDiag_1)
formdiagram_1 = ClusterOutput(data_7)

# ==== cluster Cluster_16
data = ClusterInput()
data_2 = Data(data)
python = PythonScript(CGHDtaStruct=data_2)  # -> out, fltsL_VerticesLds, RGPtsL_VerticesLds, fltsL_EdgesFcs, fltsL_EdgesFcs_2, fltsL_EdgesLgths, fltsL_EdgesQs, fltsL_EdgesAngDevns
# ---------- python: Python ----------
from compas_ghc.Utilities.PythonGrasshopperIterables    import NestedListToGrasshopperDataTree as NstdLstToGHDtaTr
from compas_ghc.Utilities.RCGeometriesDrawers           import RGPointDrawers

if CGHDtaStruct is not None:
    fltsL_EdgesFcs, fltsL_EdgesLgths, fltsL_EdgesQs, fltsL_EdgesAngDevns = CGHDtaStruct.RetrieveEdgeData(strsL_AttrNms=['f','l','q', 'a'], bool_RtnDtaLL = True)
    fltsL_VerticesLds, fltsL_VerticesResidFcs = CGHDtaStruct.RetrieveVertexData(strsL_AttrNms=['p', 'fR'], bool_RtnDtaLL = True)
    RGPtsL_VerticesLds = RGPointDrawers.CoordinatesListToRGPointsList(fltsL_VerticesLds)
# ---------- end python ----------
python_2 = PythonScript(CGHDtaStruct=data_2)  # -> out, RGPtsL_Vertices, RGPtsPairL_EdgesEndPts, RGLnsL_Edges, RGPtsLL_FacesVertices, RGPtsPllns_FacesOtlns; same code as python
python_3 = PythonScript(CGHDtaStruct=data_2)  # -> out, flt_VisScl
# ---------- python_3: Python ----------
def GetBoundAndRange (dtaL):
    _bndDta = [min(dtaL), max(dtaL)]
    _rngDta = _bndDta[1] - _bndDta[0]
    return _bndDta, _rngDta
    
_coordsL_Vertices = CGHDtaStruct.RetrieveCoordinates(CGHDtaStruct.VertexKeys())
_xL, _yL, _zL   = [list(_tup) for _tup in zip (*_coordsL_Vertices)]
_bndX, _rngX    = GetBoundAndRange(_xL)
_bndY, _rngY    = GetBoundAndRange(_yL)
_bndZ, _rngZ    = GetBoundAndRange(_zL)
flt_VisScl      = sum([_rngX, _rngY, _rngZ])/3.0
# ---------- end python_3 ----------
num = Number(python.fltsL_EdgesAngDevns)
vec = Vector(python.RGPtsL_VerticesLds)
num_2 = Number(python.fltsL_EdgesFcs_2)
pt = Point(python_2.RGPtsL_Vertices)
P = Point(pt)
crv = Curve(python_2.RGLnsL_Edges)
num_3 = Number(python_3.flt_VisScl)
vec_2 = Vector(vec)
crv_2 = Curve(crv)
num_4 = Number(num_2)
vec_3 = Vector(vec_2)
vlen = VectorLength(Vector=vec_3)
num_5 = Number(num_3)
num_6 = Number(num_4)
num_7 = Number()
num_8 = Number(Slider(50, range=0..100))
num_9 = Number(num_3)
num_10 = Number(Slider(100, range=0..100))
num_11 = Number(num_4)
num_12 = Number(Slider(50, range=0..100))
crv_3 = Curve(crv_2)
cluster = Cluster_15(num=num_6, num_4=num_5, num_2=num_7, num_3=num_8)  # -> V_5, V_4, S_5
cluster_2 = Cluster_15(num=num_11, num_4=num_9, num_2=num_10, num_3=num_12)  # -> V_5, V_4, S_5
num_13 = Number(Slider(5, range=0..100))
A = Amplitude(Slider(1.2, range=0..10))
num_14 = Number(vlen)
num_15 = Number(num_3)
num_16 = Number(Slider(20, range=0..100))
A_2 = Amplitude(Slider(2, range=0..10))
cluster_3 = Cluster_15(num=num_14, num_4=num_15, num_2=num_16, num_3=num_13)  # -> V_5, V_4, S_5
curvepoint = PointOnCurve(crv_3, parameter=0.5)
end = EndPoints(Curve=crv_3)  # -> Start, End
bool = Boolean(Toggle(True))
crv_4 = Curve(crv_2)
I = Domain(cluster.S_5)
V = Value(cluster.V_5)
I_2 = Domain(cluster_2.S_5)
V_2 = Value(cluster.V_4)
V_3 = Value(cluster_2.V_5)
V_4 = Value(cluster_2.V_4)
vec2pt = Vector2Pt(PointA=end.Start, PointB=end.End, Unitize=bool)  # -> Vector, Length
Z = UnitZ(Factor=1)
len = Length(Curve=crv_4)
dedomain = DeconstructDomain(Domain=I)  # -> Start, End
V_5 = Value(cluster_3.V_5)
vec_4 = Vector(vec2pt.Vector)
division = Division(A=len, B="2")
xprod = CrossProduct(VectorA=vec_4, VectorB=Z, Unitize=False)  # -> Vector, Length
num_17 = Number(dedomain.End)
num_18 = Number(V_3)
num_19 = Number(division)
vec_5 = Vector(xprod.Vector)
A_3 = Amplitude(V_5)
neg = Negative(Value=num_17)
vec_6 = Vector(vec_2)
P_2 = Point(P)
A_4 = Amplitude(A)
A_5 = Amplitude(A_2)
dom = ConstructDomain(DomainStart=expr("x*-1", num_18), DomainEnd=num_18)
dom_2 = ConstructDomain(DomainStart=expr("x*-1", num_19), DomainEnd=num_19)
xprod_2 = CrossProduct(VectorA=vec_4, VectorB=vec_5, Unitize=False)  # -> Vector, Length
amp = Amplitude(Vector=vec_6, Amplitude=A_3)
num_20 = Number(V_2)
num_21 = Number(neg)
vec_7 = Vector(xprod_2.Vector)
Z_2 = Z(dom)
X = X(dom_2)
Y = Y(dom)
vec_8 = Vector(amp)
gradient = Gradient(
    LowerLimit=num_21,
    UpperLimit=num_17,
    Parameter=num_20,
    stops=[0: RGB(234, 38, 0), 0.25: RGB(234, 126, 0), 0.5: RGB(254, 244, 84), 0.75: RGB(173, 203, 249), 1: RGB(75, 107, 169)])
neg_2 = Negative(Value=vec_8)
vec_9 = Vector(vec_5)
vec_10 = Vector(vec_4)
O = Origin(curvepoint)
multiplication = Multiplication(A=neg_2, B=A_4)
vec_11 = Vector(multiplication)
pl = ConstructPlane(Origin=O, XAxis=vec_10, YAxis=vec_9)
move = Move(Geometry=P_2, Motion=vec_11)  # -> Geometry, Transform
B = Base(pl)
S = Shader(gradient)
P_3 = Point(move.Geometry)
V_6 = Value(V_5)
box = DomainBox(Base=B, X=X, Y=Y, Z=Z_2)
multiplication_2 = Multiplication(A=V_6, B=A_5)
V_7 = Value(multiplication_2)
S_2 = Shader(S)
G = Geometry(box)
vdisex = VectorDisplayEx(Point=P_3, Vector=vec_8, Colour=ColourSwatch(SwatchColor=RGB(255, 0, 0)), Width=V_7)
preview = CustomPreview(Geometry=G, Shader=S_2)

# ==== cluster Cluster_5
data = ClusterInput()
pt = ClusterInput()

# ---- group: Find indices of points
data_2 = Data(data)
python = PythonScript(infoL_Anchs=data_2)  # -> iL_Anchs, rgPtsL_Anchs; inputs infoL_Anchs: list
# ---------- python: Python ----------
iL_Anchs = []
rgPtsL_Anchs = []
for _info_Anch in infoL_Anchs:
    _typ = str(type(_info_Anch))
    print _typ
    if _typ == "<type 'Point3d'>":
        rgPtsL_Anchs.append(_info_Anch)
        
    elif _typ == "<type 'str'>" or _typ == "<type 'str'>":
        try:
            _i = int(_info_Anch)
            iL_Anchs.append(_info_Anch)
        except:
            pass
# ---------- end python ----------
pt_2 = Point(pt)
pt_3 = Point(python.rgPtsL_Anchs)
pt_4 = Point(pt_3)
cp = ClosestPoint(Point=pt_4, Cloud=pt_2)  # -> ClosestPoint, CPIndex, Distance
int = Integer(python.iL_Anchs)
int_2 = Integer(cp.CPIndex)
merge = Merge(Data1=int, Data2=int_2)
cset = CreateSet(List=merge)  # -> Set, Map
int_3 = Integer(cset.Set)

# ----
tstat = TreeStatistics(Tree=pt_2)  # -> Paths, Length, Count; disabled
panel = Panel(tstat.Paths)  # disabled

int_4 = ClusterOutput(int_3)

# ==== cluster Cluster_15
num = ClusterInput()
num_2 = ClusterInput()
num_3 = ClusterInput()
num_4 = ClusterInput()
num_5 = Number(num)
num_6 = Number(num_2)
abs = Absolute(Value=num_5)
num_7 = Number(num_3)
num_8 = Number(num_4)
num_9 = Number(abs)
division = Division(A=num_8, B=num_6)
division_2 = Division(A=num_8, B=num_7)
bnd = Bounds(Numbers=num_9)
dedomain = DeconstructDomain(Domain=bnd)  # -> Start, End
python = PythonScript(x=num_6, y=division, z=dedomain.Start)  # -> a, b
# ---------- python: Python ----------
if x == None:
    a=0
    b=0
else:
    a=y
    b=z
# ---------- end python ----------
dom = ConstructDomain(DomainStart=python.a, DomainEnd=division_2)
dom_2 = ConstructDomain(DomainStart=python.b, DomainEnd=dedomain.End)
python_2 = PythonScript(fltsL=num_5)  # -> sgnsL; inputs fltsL: list
# ---------- python_2: Python ----------
sgnsL = []
for _flt in fltsL:
    if abs(_flt)>0:
        _sgn = _flt/abs(_flt)
    else:
        _sgn = 0
    sgnsL.append(_sgn)
# ---------- end python_2 ----------
S = Source(dom_2)
V = Value(num_9)
S_2 = Source(dom)
S_3 = Source(S)
remap = RemapNumbers(Value=V, Source=S_3, Target=S_2)  # -> Mapped, Clipped
num_10 = Number(python_2)
multiplication = Multiplication(A=num_10, B=remap.Mapped)
V_2 = Value(remap.Mapped)
V_3 = Value(multiplication)
S_4 = Source(S_2)
V_4 = ClusterOutput(V_3)
V_5 = ClusterOutput(V_2)
S_5 = ClusterOutput(S_4)
