# Grasshopper definition full_mockup3.gh (Grasshopper 0.9.76)
# plug-ins: Python Interpreter, Human, Kangaroo2 Components

rectangle = Rectangle(Plane=PlaneXY(0, 0, 0), XSize="-5 to 5", YSize="-5 to 5", Radius=0)  # -> Rectangle, Length
mesh_uv = MeshSurface(Surface=rectangle.Rectangle, UCount=5, VCount=5, Overhang=True, Equalize=False)
# inputs:
# -str type (edge/vertex)
# -str field (eg: q)
# -list of ID
# -list of vals
number_slider = Slider(10, range=0..10)  # disabled
mesh = Mesh(mesh_uv)
tstat = TreeStatistics(Tree=mesh)  # -> Paths, Length, Count
mesh_2 = MeshBrep(Settings={GridMaxCount=0, GridMinCount=16, JaggedSeams=False, MaxEdgeLength=0, MinEdgeLength=0.0001, MinTolerance=0, Refine=True, RefineAngle=0, RelativeTolerance=0.65, SimplePlanes=True, Tolerance=0})
panel = Panel(tstat.Paths)
# Common reloads
# 
# import compas_ghc.datastructures.StructuralDesign as sd
# reload(sd)
# import compas_ghc.utilities.InputsOutputsProcessing as iop
# reload(iop)
# 
# from compas_ghc.fdm import fdm as module_fdm
# reload (module_fdm)
# #_fdm.stop_server()
# #_fdm = Proxy('compas_ghc.fdm.fdm')
nv = NakedVertices(Mesh=mesh)  # -> ClothedIndex, NakedIndex, ClothedPts, NakedPts
anchor_points = AnchorPoints()  # disabled
loads = Loads()  # disabled
formdiagram = FormDiagram()  # disabled
random = Random(Range=Domain(0, 1), Number=number_slider, Seed=1)  # disabled
random_2 = Random(Range=Domain(0, 1), Number=number_slider, Seed=0)  # disabled
random_3 = Random(Range=Domain(0, 1), Number=number_slider, Seed=2)  # disabled
python = PythonScript()  # -> form, force; disabled
# ---------- python: Python ----------
from compas_tna.diagrams import FormDiagram
from compas_tna.diagrams import ForceDiagram

_form = FormDiagram.from_json('C:/Users/Kam-Ming Mark Tam/Documents/GitHub/AAG2018/AAG2018/src/day_1/final/aag_02_formdiagram.json')
_force = ForceDiagram.from_json('C:/Users/Kam-Ming Mark Tam/Documents/GitHub/AAG2018/AAG2018/src/day_1/final/aag_03_forcediagram.json')

form = _form
force = _force

_form.set_edges_attribute('fmin', 0.2)
_form.set_edges_attribute('fmax', 5.0)
# ---------- end python ----------

# ---- group: Proxy Reset
python_2 = PythonScript()  # -> out, a
# ---------- python_2: Python ----------
from compas.rpc import Proxy
compas_tna = Proxy('compas_ghc.tna')
compas_tna.stop_server()
compas_tna = Proxy('compas_ghc.tna')
# ---------- end python_2 ----------

# ----
mc = MeshCorners(Mesh=mesh, Angle=2.35619449)
cluster = Cluster_5(mesh=mesh)
demesh = DeconstructMesh(Mesh=mesh)  # -> Vertices, Faces, Colours, Normals
data = Data(anchor_points)  # disabled
data_2 = Data(python.form)  # disabled
data_3 = Data(formdiagram)  # disabled
tstat_2 = TreeStatistics(Tree=cluster)  # -> Paths, Length, Count
pt = ConstructPoint(XCoordinate=random_3, YCoordinate=random, ZCoordinate=random_2)  # disabled
python_3 = PythonScript()  # -> out, guid; disabled
# ---------- python_3: Python ----------
from compas_pattern.cad.rhino.utilities import draw_mesh

guid = draw_mesh(quad_mesh_datastructure, group = False)
# ---------- end python_3 ----------
pt_2 = Point(nv.ClothedPts)
pt_3 = Point(mc)
panel_2 = Panel(tstat_2.Paths)
createloads = CreateLoads(loaded_point_s=demesh.Vertices)
pt_4 = Point(pt_2)
panel_3 = Panel("e")
panel_4 = Panel("""2
2
2""")
panel_5 = Panel("q")
data_4 = Data(createloads)
assemblestructuraldesign = AssembleStructuralDesign_2()  # disabled
cluster_2 = Cluster_10()
special_symbols = Panel("""Γ Γ✵

⚓ 
↓↓↓

⓿ ➊

✐ℹⓘ""")

# ---- group: DisassembleStructuralDesign
cluster_3 = Cluster_2()  # -> structuraldesign_1, forcediagram_1; disabled

# ----
specifydesignboundaries = SpecifyDesignBoundaries(formdiagram=cluster, anchor_points=pt_3, loads=data_4)

# ---- group: SpecifyDesignBoundaries
specifydesign = SpecifyDesign(formdiagram=cluster, anchor_points=simplify(pt_3), loads=data_4, elements_modifications_instructions=cluster_2)

# ----
data_5 = Data(specifydesignboundaries)
mesh_3 = Mesh(mesh)  # disabled
demesh_2 = DeconstructMesh(Mesh=mesh_3)  # -> Vertices, Faces, Colours, Normals; disabled
cluster_4 = Cluster_5(mesh=mesh_3)  # disabled
points = PointList(Points=demesh_2.Vertices)  # disabled
panel_7 = Panel(demesh_2.Vertices)  # disabled
cluster_5 = Cluster_6(diagram=cluster_4)  # disabled
mesh_4 = Mesh(cluster_5)  # disabled
demesh_3 = DeconstructMesh(Mesh=mesh_4)  # -> Vertices, Faces, Colours, Normals; disabled

# ---- group: Γ
data_6 = Data(specifydesignboundaries)

data_7 = Data(specifydesignboundaries)

# ----
points_2 = PointList(Points=demesh_3.Vertices)  # disabled
assemblestructuraldesign_2 = AssembleStructuralDesign(formdiagram=data_6)

# ---- group: DisassembleStructuralDesign
cluster_6 = Cluster_2(structuraldesign_0=assemblestructuraldesign_2)  # -> structuraldesign_1, forcediagram_1

# ----
number_slider_2 = Slider(10, range=0..100)  # disabled
cluster_7 = Cluster_6(diagram=cluster_6.structuraldesign_1)

# ---- group: structDsg
data_8 = Data(assemblestructuraldesign_2)

# ----
forcedensitysolver = ForceDensitySolver(structuraldesign_⓿=assemblestructuraldesign_2)  # -> structuraldesign_➊, forcediagram_➊, forces_➊, lengths_➊
mesh_5 = Mesh(cluster_7)
num = Number(number_slider_2)  # disabled
data_9 = Data(data_7)  # disabled
demesh_4 = DeconstructMesh(Mesh=mesh_5)  # -> Vertices, Faces, Colours, Normals
python_4 = PythonScript()  # -> flatten(a)
# ---------- python_4: Python ----------
a=x
# ---------- end python_4 ----------
python_5 = PythonScript(cDtaStruct=data_9)  # -> out, vKeysL_Vertices, rgPtsL_Vertices, eKeysL_Edges, rgLnsL_Edges, vKeysL_Anchs, rgPtsL_Anchs, vKeysL_LddVertices, rgPtsL_LddVertices, rgVecsL_VerticesLds; disabled
# ---------- python_5: Python ----------
import compas_ghc.utilities.Convertors as cvt
reload(cvt)

from compas_ghc.utilities.Convertors import DisassembleCompasDataStructures as DiasmCpDtaStruct
from compas_ghc.utilities.Convertors import DrawDisassembledCompasDataStructures as DwDiasmdCpDtaStruct
#from compas_ghc.utilities.InputsOutputsProcessing import GrasshopperInputsGate
#from compas_ghc.utilities.InputsOutputsProcessing import IsCompasDataStructure as IsCpDtaStruct
#from compas_ghc.utilities.InputsOutputsProcessing import SetDefaultInput as SetDfltInp

_cDtaStruct             = cDtaStruct
_dct_DiasmdDta          = DiasmCpDtaStruct(_cDtaStruct)

_vKeysL_Vertices        = _dct_DiasmdDta['vertices']['vKeys'] 
_eKeysL_Edges           = _dct_DiasmdDta['edges']['eKeys'] 
_eKeysL_Edges           = [str(_eKey) for _eKey in _eKeysL_Edges]
_vKeysL_Anchs           = _dct_DiasmdDta['anchors']['vKeys']
_vKeysL_LddVertices     = _dct_DiasmdDta['loads']['vKeys']

_rgPtsL_Vertices, _rgLnsL_Edges, _rgPtsL_Anchs, _rgPtsL_LddVertices, _rgVecsL_VerticesLds = DwDiasmdCpDtaStruct(_dct_DiasmdDta)

vKeysL_Vertices         = _vKeysL_Vertices
rgPtsL_Vertices         = _rgPtsL_Vertices

eKeysL_Edges            = _eKeysL_Edges
rgLnsL_Edges            = _rgLnsL_Edges

vKeysL_Anchs            = _vKeysL_Anchs
rgPtsL_Anchs            = _rgPtsL_Anchs

vKeysL_LddVertices      = _vKeysL_LddVertices
rgPtsL_LddVertices      = _rgPtsL_LddVertices
rgVecsL_VerticesLds     = _rgVecsL_VerticesLds

import rhinoscriptsyntax as rs


#print (_dct_DiasmdData)
#if IsCpDtaStruct(_cDtaStruct):
#    pass
# ---------- end python_5 ----------
cluster_8 = Cluster_6(diagram=forcedensitysolver.forcediagram_➊)
python_6 = PythonScript(structDsg_0=data_8)  # -> out, structDsg_1, formDiag_1
# ---------- python_6: Python ----------
import compas
import time

import rhinoscriptsyntax as rs

from compas_ghc.fdm import fdm as module_fdm
reload (module_fdm)
from compas.rpc import Proxy
from compas_tna.diagrams import FormDiagram
from copy import deepcopy

import compas
import time

import rhinoscriptsyntax as rs

from compas_ghc.fdm import fdm as module_fdm
reload (module_fdm)
from compas.rpc import Proxy
from compas_tna.diagrams import FormDiagram
from copy import deepcopy

_flt_TtlSWLd = 0 ##CHANGE

_structDsg_0 = deepcopy(structDsg_0)
_formDiag = structDsg_0.formDiag

from compas_ghc.fdm.fdm import CompileForceDensitySolverInputs
from compas_ghc.fdm.fdm import CompileForceDensityLoads
a, b, c, d = CompileForceDensitySolverInputs(_formDiag)
print a
print ()
print b
print ()
print c
print ()
print d
e   = CompileForceDensityLoads(_formDiag, _flt_TtlSWLd, False)
print ()
print ()
print (e)
# ---------- end python_6 ----------
python_7 = PythonScript()  # -> Out, A
pt_5 = Point(python_5.rgPtsL_LddVertices)  # disabled
vec = Vector(python_5.rgVecsL_VerticesLds)  # disabled
int = Integer(python_5.vKeysL_LddVertices)  # disabled
txt = Text(python_5.eKeysL_Edges)  # disabled
crv = Curve(python_5.rgLnsL_Edges)  # disabled
int_2 = Integer(python_5.vKeysL_Anchs)  # disabled
pt_6 = Point(python_5.rgPtsL_Anchs)  # disabled
int_3 = Integer(python_5.vKeysL_Vertices)  # disabled
pt_7 = Point(python_5.rgPtsL_Vertices)  # disabled
crv_2 = Curve(crv)  # disabled
python_8 = PythonScript()  # -> out, simplify(a); same code as python_4
python_9 = PythonScript()  # -> out, simplify(a); same code as python_4
number_slider_3 = Slider(5, range=0..10)  # disabled

# ---- group: CreateDualDiagram
cluster_9 = Cluster(structuraldesign_0=data_8)  # -> structuraldesign_1, forcediagram_1; disabled

# ----
pt_8 = Point(pt_7)  # disabled
pdecon = Deconstruct(Point=pt_8)  # -> XComponent, YComponent, ZComponent; disabled
cluster_10 = Cluster_8(num=pdecon.YComponent)  # disabled
cluster_11 = Cluster_8(num=pdecon.XComponent)  # disabled
cluster_12 = Cluster_8(num=pdecon.ZComponent)  # disabled
merge = Merge(Data1=cluster_11, Data2=cluster_10)  # disabled
sort = SortList(Keys=merge)  # -> Keys, ValuesA; disabled
item = ListItem(List=sort.Keys, Index=0, Wrap=True)  # -> Item1, Item; disabled
num_2 = Number(item.Item)  # disabled

end = EndPoints(Curve=crv_2)  # -> Start, End; disabled
cluster_13 = Cluster_6(diagram=data_6)  # disabled
item_2 = ListItem(List=python_8.a, Index=0, Wrap=True)  # -> Item, Item1, Item2
item_3 = ListItem(List=python_9.a, Index=0, Wrap=True)  # -> Item, Item1, Item2
mesh_6 = Mesh(cluster_8)
vec2pt = Vector2Pt(PointA=end.Start, PointB=end.End, Unitize=False)  # -> Vector, Length; disabled
pt_9 = ConstructPoint(XCoordinate=item_2.Item, YCoordinate=item_2.Item1, ZCoordinate=item_2.Item2)
pt_10 = ConstructPoint(XCoordinate=item_3.Item, YCoordinate=item_3.Item1, ZCoordinate=item_3.Item2)
number_slider_4 = Slider(100, range=0..100)  # disabled
number_slider_5 = Slider(50, range=0..100)  # disabled
pt_11 = Point(flatten(pt_10))
vec_2 = Vector(flatten(pt_9))
demesh_5 = DeconstructMesh(Mesh=mesh_6)  # -> Vertices, Faces, Colours, Normals
vec_3 = Vector(vec2pt.Vector)  # disabled
Z = UnitZ(Factor=1)  # disabled
mesh_7 = Mesh(cluster_13)  # disabled
number_slider_6 = Slider(0.5, range=0..1)
previewlw = CustomPreviewLineweights(
    Geometry=crv_2,
    Shader={ambient=RGB(0, 0, 0), diffuse=RGB(255, 105, 180), emission=RGB(76, 32, 54), shine=0.5, specular=RGB(255, 255, 255), transparency=0},
    Thickness=number_slider_3,
    Absolute=False)  # disabled
xprod = CrossProduct(VectorA=vec_3, VectorB=Z, Unitize=False)  # -> Vector, Length; disabled
curvepoint = PointOnCurve(crv_2, parameter=0.5)  # disabled

# ---- group: structDsg
data_10 = Data(cluster_9.structuraldesign_1)  # disabled

# ----
vdis = VectorDisplay(Anchor=pt_11, Vector=vec_2)
vec_4 = Vector(xprod.Vector)  # disabled
points_3 = PointList(Points=demesh_5.Vertices, Size=number_slider_6)
int_4 = Integer(number_slider_4)  # disabled
panel_9 = Panel(demesh_5.Vertices)
int_5 = Integer(number_slider_5)  # disabled
pl = ConstructPlane(Origin=curvepoint, XAxis=vec_3, YAxis=vec_4)  # disabled
points_4 = PointList(Points=pt_11, Size=number_slider_6)

# ---- group: HorizontalEquilibrium
cluster_14 = Cluster_3(structuraldesign_0=data_10, alpha=int_5, maxiterations=int_4)  # -> structuraldesign_1, formdiagram_1, forcediagram_1; disabled

# ----
pln = Plane(pl)  # disabled
C = Curve(crv_2)  # disabled
vec_5 = Vector(vec_3)  # disabled
vec_6 = Vector(vec_4)  # disabled
pln_2 = Plane(pln)  # disabled

# ---- group: structDsg
data_11 = Data(cluster_14.structuraldesign_1)  # disabled

# ----
number_slider_7 = Slider(6, range=0..10)  # disabled
xprod_2 = CrossProduct(VectorA=vec_5, VectorB=vec_6, Unitize=False)  # -> Vector, Length; disabled
boxrec = BoxRectangle(Height=Domain(0, 10))  # disabled
cluster_15 = Cluster_9(B=pt_6, A=num_2, num=num)  # disabled

# ---- group: VerticalEquilibrium
cluster_16 = Cluster_4(structuraldesign_0=data_11, maxheight=number_slider_7)  # -> structuraldesign_1, formdiagram_1; disabled

# ----
data_12 = Data()  # disabled
data_13 = Data()  # disabled
num_3 = Number()  # disabled
num_4 = Number()  # disabled
vec_7 = Vector(xprod_2.Vector)  # disabled
data_14 = Data(data_12)  # disabled
data_15 = Data(data_13)  # disabled
num_5 = Number(num_3)  # disabled
num_6 = Number(num_4)  # disabled
python_10 = PythonScript(infoL_Anchs=data_15)  # -> iL_Anchs, rgPtsL_Anchs; inputs infoL_Anchs: list; disabled
# ---------- python_10: Python ----------
iL_Anchs = []
rgPtsL_Anchs = []
for _info_Anch in infoL_Anchs:
    _typ = str(type(_info_Anch))
    print _typ
    if _typ == "<type 'Point3d'>":
        rgPtsL_Anchs.append(_info_Anch)
    elif _typ == "<type 'str'>" or _typ == "<type 'str'>":
        try:
            _i = int(_info_Anch)
            iL_Anchs.append(_info_Anch)
        except:
            pass
# ---------- end python_10 ----------
pt_12 = Point()  # disabled
pt_13 = Point(python_10.rgPtsL_Anchs)  # disabled
pt_14 = Point(pt_12)  # disabled
pt_15 = Point(pt_13)  # disabled
pt_16 = Point(pt_14)  # disabled
cp = ClosestPoint(Point=pt_15, Cloud=pt_16)  # -> ClosestPoint, CPIndex, Distance; disabled
box = Box(cluster_15)  # disabled
int_6 = Integer(python_10.iL_Anchs)  # disabled
int_7 = Integer(cp.CPIndex)  # disabled
merge_2 = Merge(Data1=int_6, Data2=int_7)  # disabled
cset = CreateSet(List=merge_2)  # -> Set, Map; disabled
int_8 = Integer(cset.Set)  # disabled
python_11 = PythonScript(mesh=data_14, loadTotal=num_5, q=num_6, fixed=int_8)  # -> out, verticesNew, linesNew, force, length, strsL_ErrMsgs; inputs fixed: list of Int32; disabled
# ---------- python_11: Python ----------
import compas
import time

import rhinoscriptsyntax as rs

from compas.datastructures import Mesh
from compas.utilities import XFunc
from compas.rpc import Proxy

numerical = Proxy('compas.numerical')


def _updateVerticesCoordinates (mesh, xyz):
    for key, attr in mesh.vertices(True):
       attr['x'] = xyz[key][0]
       attr['y'] = xyz[key][1]
       attr['z'] = xyz[key][2]
    return mesh;
       

len_vertices = mesh.number_of_vertices()
_load = loadTotal/len_vertices

i=0

from copy import deepcopy
_mesh = deepcopy(mesh)
while (i<2):

    vertices = _mesh.get_vertices_attributes('xyz')
    
    verticesAreas=[]
    for _vkey in _mesh.vertex.keys():
        verticesAreas.append(_mesh.vertex_area(_vkey))
    sum_VerticesAreas = sum(verticesAreas)
    _loadFactor = loadTotal / sum_VerticesAreas
    _loads = [[0,0,verticesAreas[_vkey]*_loadFactor] for _vkey in _mesh.vertex.keys()]
    
    edges    = list(_mesh.edges())
    #fixed    = list([key for key in mesh.vertices() if mesh.vertex_degree(key) == 2])
    q        = _mesh.get_edges_attribute('q', 1.0)
    loads    = _mesh.get_vertices_attributes(('px', 'py', 'pz'), (0.0, 0.0, _load))
    
    xyzs, q, f, l, r = numerical.fd_numpy(vertices, edges, fixed, q, _loads)
    
    _mesh = _updateVerticesCoordinates (_mesh, xyzs)

    i+=1
    
    verticesNew=[]
    [verticesNew.append(rs.AddPoint(_xyz[0],_xyz[1],_xyz[2])) for _xyz in xyzs]
    linesNew=[]
    [linesNew.append(rs.AddLine(verticesNew[_ekey[0]],verticesNew[_ekey[1]])) for _ekey in _mesh.edges()]
    force = [_f[0] for _f in f]
    



#length = [rs.CurveLength(_line) for _line in linesNew]
#
#print(type(xyz))
#


# plotter = MeshPlotter(mesh)
# plotter.draw_vertices()
# plotter.draw_faces()
# plotter.draw_edges()
# plotter.show()
#
#print(fd_numpy.profile)
#
# ---------- end python_11 ----------
crv_3 = Curve(python_11.linesNew)  # disabled
pt_17 = Point(python_11.verticesNew)  # disabled
crv_4 = Curve(crv_3)  # disabled
pt_18 = Point(pt_17)  # disabled

# ==== cluster AssembleStructuralDesign
formdiagram = ClusterInput()
forcediagram = ClusterInput()
python = PythonScript(formDiag=formdiagram, forceDiag=forcediagram)  # -> structDsg
# ---------- python: Python ----------
#from compas.rpc import Proxy
#reload(compas_ghc.datastructures.StructuralDesign)
import compas_ghc.utilities.InputsOutputsProcessing as _IOP
reload(_IOP)
import compas_ghc.datastructures.StructuralDesign as _SD
reload(_SD)

from compas_ghc.datastructures.StructuralDesign import StructuralDesign as StructDsg


#if form or force diagrams are valid?
_structDsg = StructDsg()

if formDiag is not None:
    _structDsg.SetFormDiagram(formDiag)
    
if forceDiag is not None:
    _structDsg.SetForceDiagram(forceDiag)
    
structDsg = _structDsg
# ---------- end python ----------
structuraldesign = ClusterOutput(python)

# ==== cluster Cluster
structuraldesign_0 = ClusterInput()
createdualdiagram = PythonScript(structDsg_0=structuraldesign_0)  # -> structDsg_1, forceDiag_1
# ---------- createdualdiagram: Python ----------
#from compas_tna.rhino import DiagramHelper
from compas_tna.diagrams import ForceDiagram

if structDsg_0 is not None:
    _structDsg_0    = structDsg_0
    _formDiag       = _structDsg_0.formDiag
    _forceDiag      = ForceDiagram.from_formdiagram(_formDiag)
    _structDsg_0.SetForceDiagram(_forceDiag)

    structDsg_1 = _structDsg_0
    forceDiag_1 = _forceDiag
# ---------- end createdualdiagram ----------
structuraldesign_1 = ClusterOutput(createdualdiagram.structDsg_1)
forcediagram_1 = ClusterOutput(createdualdiagram.forceDiag_1)

# ==== cluster AssembleStructuralDesign_2
formdiagram = ClusterInput()
forcediagram = ClusterInput()
python = PythonScript(formDiag=formdiagram, forceDiag=forcediagram)  # -> structDsg
# ---------- python: Python ----------
#from compas.rpc import Proxy
#reload(compas_ghc.datastructures.StructuralDesign)
from compas_ghc.datastructures.StructuralDesign import StructuralDesign as StructDsg


#if form or force diagrams are valid?
_structDsg = StructDsg()

if formDiag is not None:
    _structDsg.SetFormDiagram(formDiag)
    
if forceDiag is not None:
    _structDsg.SetForceDiagram(forceDiag)
    
structDsg = _structDsg
# ---------- end python ----------
structuraldesign = ClusterOutput(python)

# ==== cluster Cluster_2
structuraldesign_0 = ClusterInput()
createdualdiagram = PythonScript(structDsg_0=structuraldesign_0)  # -> formDiag, forceDiag
# ---------- createdualdiagram: Python ----------
#from compas_tna.rhino import DiagramHelper
from compas_tna.diagrams import ForceDiagram

if structDsg_0 is not None:
    _structDsg_0    = structDsg_0
    
    _formDiag       = _structDsg_0.formDiag
    _forceDiag      = _structDsg_0.forceDiag
    
    
    formDiag        = _formDiag
    forceDiag       = _forceDiag
# ---------- end createdualdiagram ----------
structuraldesign_1 = ClusterOutput(createdualdiagram.formDiag)
forcediagram_1 = ClusterOutput(createdualdiagram.forceDiag)

# ==== cluster Cluster_3
structuraldesign_0 = ClusterInput()
alpha = ClusterInput()  # default: 100
maxiterations = ClusterInput()  # default: 100
data = Data(alpha)
data_2 = Data(maxiterations)
data_3 = Data(structuraldesign_0)
python = PythonScript(structDsg_0=data_3, flt_Alpha=data, int_KMax=data_2)  # -> structDsg_1, formDiag_1, forceDiag_1
# ---------- python: Python ----------
from compas_ghc.utilities.InputsOutputsProcessing import GrasshopperInputsGate
from compas_ghc.utilities.InputsOutputsProcessing import SetDefaultInput as SetDfltInp
from compas_ghc.datastructures.StructuralDesign import StructuralDesign as StructDsg


_structDsg_0=structDsg_0
if GrasshopperInputsGate(_structDsg_0, 'StructuralDesign'):
    
    from compas.rpc import Proxy
    _tna = Proxy('compas_ghc.tna')

    from copy import deepcopy
    from compas_tna.diagrams import FormDiagram
    from compas_tna.diagrams import ForceDiagram
    
    _formDiag_0, _forceDiag_0 = _structDsg_0.OutputDualDiagrams()
    
    _flt_Alpha = SetDfltInp(flt_Alpha, 100)
    _int_KMax = SetDfltInp(int_KMax, 100)

    _formData_0 = deepcopy(_formDiag_0.to_data())
    _forceData_0 = deepcopy(_forceDiag_0.to_data())
    _formData_1, _forceData_1 = _tna.horizontal_nodal_from_data(_formData_0 , _forceData_0, alpha=_flt_Alpha, kmax=_int_KMax)
    try:
        _formData_1, _forceData_1 = _tna.horizontal_nodal_from_data(_formData_0 , _forceData_0, alpha=_flt_Alpha, kmax=_int_KMax)
        try:
            _formDiag_1     = FormDiagram.from_data(_formData_1)
            _forceDiag_1    = ForceDiagram.from_data(_forceData_1)
        
            _structDsg_1    = StructDsg()
            _structDsg_1.SetDualDiagrams(_formDiag_1, _forceDiag_1)
            
            formDiag_1      = _formDiag_1
            forceDiag_1     = _forceDiag_1
            structDsg_1     = _structDsg_1
        except:
            pass
        
    except:
        pass
# ---------- end python ----------
data_4 = Data(python.structDsg_1)
data_5 = Data(python.forceDiag_1)
data_6 = Data(python.formDiag_1)
formdiagram_1 = ClusterOutput(data_6)
structuraldesign_1 = ClusterOutput(data_4)
forcediagram_1 = ClusterOutput(data_5)

# ==== cluster Cluster_4
structuraldesign_0 = ClusterInput()
maxheight = ClusterInput()
maxiterations = ClusterInput()
data = Data(maxiterations)
data_2 = Data(maxheight)
data_3 = Data(structuraldesign_0)
python = PythonScript(structDsg_0=data_3, int_KMax=data, flt_ZMax=data_2)  # -> out, structDsg_1, formDiag_1
# ---------- python: Python ----------
from compas_ghc.utilities.InputsOutputsProcessing import GrasshopperInputsGate
from compas_ghc.utilities.InputsOutputsProcessing import SetDefaultInput as SetDfltInp
from compas_ghc.datastructures.StructuralDesign import StructuralDesign as StructDsg


_structDsg_0=structDsg_0
if GrasshopperInputsGate(_structDsg_0, 'StructuralDesign'):
    
    from compas.rpc import Proxy
    _tna = Proxy('compas_ghc.tna')

    from copy import deepcopy
    from compas_tna.diagrams import FormDiagram
    
    _formDiag_0, _forceDiag_0 = _structDsg_0.OutputDualDiagrams()
    
    _int_KMax = SetDfltInp(int_KMax, 100)
    _flt_ZMax = SetDfltInp(flt_ZMax, 5)

    _formData_0 = deepcopy(_formDiag_0.to_data())

    try:
        
        _formData_1, _scale = _tna.vertical_from_zmax_from_data(_formData_0, zmax = _flt_ZMax, kmax = _int_KMax)
        

        try:
            _formDiag_1     = FormDiagram.from_data(_formData_1)
        
            _structDsg_1    = StructDsg()
            _forceDiag_1    = deepcopy (_forceDiag_0)
            _structDsg_1.SetDualDiagrams(_formDiag_1, _forceDiag_1)
            
            formDiag_1      = _formDiag_1
            structDsg_1     = _structDsg_1
        except:
            pass
        
    except:
        pass
# ---------- end python ----------
data_4 = Data(python.structDsg_1)
data_5 = Data(python.formDiag_1)
formdiagram_1 = ClusterOutput(data_5)
structuraldesign_1 = ClusterOutput(data_4)

# ==== cluster Cluster_5
mesh = ClusterInput()
data = Data(mesh)
python_script = PythonScript(rgMesh=data)  # -> out, cMesh
# ---------- python_script: Python ----------
from compas_ghc.utilities.InputsOutputsProcessing import GrasshopperInputsGate
from compas_ghc.utilities.InputsOutputsProcessing import SetDefaultInput as SetDfltInp
from compas_ghc.datastructures.StructuralDesign import StructuralDesign as StructDsg



_rgMesh = rgMesh
if GrasshopperInputsGate(_rgMesh, 'Guid'):
    from compas_rhino.geometry import RhinoMesh
    from compas.datastructures import Mesh
    _cMesh = Mesh.from_vertices_and_faces(*(RhinoMesh.from_guid(rgMesh).get_vertices_and_faces()))
    cMesh = _cMesh
# ---------- end python_script ----------
data_2 = Data(python_script.cMesh)
diagram = ClusterOutput(data_2)

# ==== cluster Cluster_6
diagram = ClusterInput()
data = Data(diagram)
python = PythonScript(cDtaStruct=data)  # -> out, GUID
# ---------- python: Python ----------
import compas_ghc.utilities.InputsOutputsProcessing as iop
reload(iop)

from compas_ghc.utilities.InputsOutputsProcessing import GrasshopperInputsGate
from compas_ghc.utilities.InputsOutputsProcessing import IsCompasDataStructure as IsCpDtaStruct
from compas_ghc.utilities.InputsOutputsProcessing import SetDefaultInput as SetDfltInp

_cDtaStruct = cDtaStruct

if IsCpDtaStruct(_cDtaStruct):
    from compas_pattern.cad.rhino.utilities import draw_mesh
    _GUID = draw_mesh(_cDtaStruct, group = False)
    GUID = _GUID
# ---------- end python ----------
data_2 = Data(python.GUID)
mesh = ClusterOutput(data_2)

# ==== cluster CreateLoads
load_vector_s = ClusterInput()
loaded_point_s = ClusterInput()
vec = Vector(load_vector_s)
pt = Point(loaded_point_s)
bool = Boolean()
vec_2 = Vector("0,0,-1")
python = PythonScript(rgPtsL=pt, rgVecsL=vec, rgVec_DfltLd=vec_2, bool_RedistrLds=bool)  # -> out, structLdsL; inputs rgPtsL: list of Point3d, rgVecsL: list of Vector3d, rgVec_DfltLd: Vector3d
# ---------- python: Python ----------
import compas_ghc.datastructures.StructuralDesign as sd
reload(sd)
import compas_ghc.utilities.InputsOutputsProcessing as iop
reload(iop)

#from compas_rhino.geometry import RhinoPoint 

from compas_ghc.utilities.InputsOutputsProcessing import GrasshopperInputsGate
from compas_ghc.utilities.InputsOutputsProcessing import SetDefaultInput as SetDfltInp
from compas_ghc.utilities.InputsOutputsProcessing import MatchListsLengths as MatchLstLgths
from compas_ghc.datastructures.StructuralDesign import StructuralDesign as StructDsg
from compas_ghc.datastructures.StructuralDesign import StructuralLoad as StructLd
#from compas_rhino.geometry import RhinoPoin

#Process inputs and match lists
_rgPtsL = rgPtsL
_rgVecsL = SetDfltInp(rgVecsL, rgVec_DfltLd, bool_LstOtp = True)

_len_Pts = len(_rgPtsL)
_len_Vecs = len(_rgVecsL)
_rgVecsL = MatchLstLgths(_rgPtsL, _rgVecsL)

_zipLdsInfo = zip(_rgPtsL, _rgVecsL)

if _len_Pts > 0: #GrasshopperInputsGate(_rgPtsL, 'Guid'):
    _structLdsL = []
    for __rgPt, __rgVec in _zipLdsInfo:
        
        print (__rgPt, __rgVec)
        __coords    = [__rgPt.X, __rgPt.Y, __rgPt.Z]
        __vec       = [__rgVec.X, __rgVec.Y, __rgVec.Z]
        __structLd  = StructLd(__coords, __vec)
        _structLdsL.append(__structLd)
    structLdsL = _structLdsL
# ---------- end python ----------
data = Data(python.structLdsL)
cghloads = ClusterOutput(data)

# ==== cluster SpecifyDesignBoundaries
formdiagram = ClusterInput()
anchor_points = ClusterInput()
loads = ClusterInput()
data = Data(formdiagram)
data_2 = Data(anchor_points)
data_3 = Data(loads)
data_4 = Data(data_3)
python = PythonScript(inp_Dta=data)  # -> formDiag, str_InpTyp, strCoordsL
# ---------- python: Python ----------
#from compas_tna.diagrams import formdiagram 
#reload(formdiagram)
from compas_tna.diagrams import FormDiagram

_inp_Dta = inp_Dta
if _inp_Dta is not None:
    _formDiag = None
    if (_inp_Dta.__class__.__name__ == 'Guid'):
        from compas_rhino.geometry import RhinoMesh
        _formDiag = FormDiagram.from_vertices_and_faces(*(RhinoMesh.from_guid(_inp_Dta).get_vertices_and_faces()))
        str_InpTyp = 'GUID'
        
    elif (_inp_Dta.__class__.__name__ == 'Mesh'):
        _formDiag = FormDiagram.from_data(_inp_Dta.to_data())
        str_InpTyp = 'cMesh'
        
    elif (_inp_Dta.__class__.__name__ == 'FormDiagram'):
        _formDiag = _inp_Dta
        str_InpTyp = 'cFormDiagram'
        
    formDiag = _formDiag
    
if formDiag is not None:
    coordsL = [formDiag.vertex_coordinates(_vKey) for _vKey in formDiag.vertex.keys()]
    strCoordsL = []
    [strCoordsL.append('{'+str(_coords[0])+','+str(_coords[1])+','+str(_coords[2])+'}') for _coords in coordsL]
# ---------- end python ----------
python_2 = PythonScript(structLdsL=data_4)  # -> out, strCoordsL_LdsPos, vecsLw_LdsDirMag; inputs structLdsL: list
# ---------- python_2: Python ----------
_structLdsL = structLdsL
_strCoordsL_LdsPos = []
_vecsL = [] 


for _structLd in _structLdsL:
    _coords = _structLd.coords
    _vec    = _structLd.vec
    _strCoordsL_LdsPos.append('{'+str(_coords[0])+','+str(_coords[1])+','+str(_coords[2])+'}')
    _vecsL.append(_vec)

vecsLw_LdsDirMag = [_vecsL] #to address GH's output processing when only one load is supplied
strCoordsL_LdsPos = _strCoordsL_LdsPos
# ---------- end python_2 ----------

# ---- group: !MvToCode
trim = TrimTree(Tree=python.strCoordsL, Depth=1)

# ----
tstat = TreeStatistics(Tree=data_4)  # -> Paths, Length, Count; disabled
panel = Panel(tstat.Paths)  # disabled

data_5 = Data(python.formDiag)
pt = Point(trim)
pt_2 = Point(python_2.strCoordsL_LdsPos)
data_6 = Data(python_2.vecsLw_LdsDirMag)
pt_3 = Point(pt)
pt_4 = Point(pt)
data_7 = Data(data_2)
data_8 = Data(pt_2)
cluster = Cluster_7(data=data_8, pt=pt_4)
cluster_2 = Cluster_7(data=data_7, pt=pt_3)
data_9 = Data(data_5)
int = Integer(cluster_2)
int_2 = Integer(cluster)
data_10 = Data(data_9)
int_3 = Integer(int)
data_11 = Data(data_6)
data_12 = Data(int_2)
python_3 = PythonScript(formDiag_0=data_10, vKeysL_Anchs=int_3, vKeysL_LdsPos=data_12, vecsLw_LdsDirMag=data_11)  # -> out, formDiag_1; inputs vKeysL_Anchs: list of Int32, vKeysL_LdsPos: list of Int32, vecsLw_LdsDirMag: list
# ---------- python_3: Python ----------
from compas_ghc.utilities.InputsOutputsProcessing import GrasshopperInputsGate
from compas_ghc.utilities.InputsOutputsProcessing import SetDefaultInput as SetDfltInp
from compas_ghc.datastructures.StructuralDesign import StructuralDesign as StructDsg


_formDiag_0 =   formDiag_0
_vKeysL_Anchs = vKeysL_Anchs
_vKeysL_LdsPos = vKeysL_LdsPos
_vecsL_LdsDirMag = vecsLw_LdsDirMag[0]

print (_vecsL_LdsDirMag)

if GrasshopperInputsGate(_formDiag_0, 'FormDiagram'):
    if len(_vKeysL_Anchs) > 0:
        _formDiag_0.set_vertices_attribute('is_anchor', True, _vKeysL_Anchs)

    if len(_vKeysL_LdsPos) > 0:
        zipLdsInfo = zip(_vKeysL_LdsPos, _vecsL_LdsDirMag)
        for __vKey_LdPos, __vec_LdDirMag in zipLdsInfo:
            print ('loaded vKey: ', __vKey_LdPos, ' with: ', __vec_LdDirMag)
            _formDiag_0.set_vertex_attributes(__vKey_LdPos, ['px','py','pz'],__vec_LdDirMag)
            
    formDiag_1 = _formDiag_0

#for _vKey, _attr in formDiag_1.vertex.items():
#    print (_vKey, _attr)
# ---------- end python_3 ----------
data_13 = Data(python_3.formDiag_1)
data_14 = Data(data_13)
formdiagram_1 = ClusterOutput(data_14)

# ==== cluster Cluster_8
num = ClusterInput()
num_2 = Number(num)
bnd = Bounds(Numbers=num_2)
dedomain = DeconstructDomain(Domain=bnd)  # -> Start, End
subtraction = Subtraction(A=dedomain.End, B=dedomain.Start)
num_3 = Number(subtraction)
num_4 = ClusterOutput(num_3)

# ==== cluster Cluster_9
A = ClusterInput()
num = ClusterInput()
B = ClusterInput()
A_2 = A(A)
num_2 = Number(num)
num_3 = Number("20")
num_4 = Number("0.1")
B_2 = Base(B)
python = PythonScript(flt_Rng=A_2, flt_DivFac=num_2, flt_DivFac_Dflt=num_3, flt_MinVal=num_4)  # -> out, flt_Val
# ---------- python: Python ----------
if flt_DivFac is None:
    flt_DivFac = flt_DivFac_Dflt
flt_Val=max(flt_MinVal, flt_Rng/flt_DivFac)
# ---------- end python ----------
num_5 = Number(python.flt_Val)
dom = ConstructDomain(DomainStart=expr("-x/2", num_5), DomainEnd=expr("x/2", num_5))
X = X(dom)
box = DomainBox(Base=B_2, X=X, Y=X, Z=X)
box_2 = Box(box)
box_3 = ClusterOutput(box_2)

# ==== cluster ForceDensitySolver
structuraldesign_⓿ = ClusterInput()
data = Data(structuraldesign_⓿)
python = PythonScript(structDsg_0=data)  # -> out, structDsg_1, formDiag_1, fltsL_EdgeForces, fltsL_EdgeLgths, strsL_ErrMsgs
# ---------- python: Python ----------
from compas_ghc.utilities.InputsOutputsProcessing import GrasshopperInputsGate
from compas_ghc.utilities.InputsOutputsProcessing import SetDefaultInput as SetDfltInp
from compas_ghc.datastructures.StructuralDesign import StructuralDesign as StructDsg


_structDsg_0=structDsg_0
if GrasshopperInputsGate(_structDsg_0, 'StructuralDesign'):
    from compas.rpc import Proxy
    from compas_tna.diagrams import FormDiagram
    from copy import deepcopy
    
    _flt_TtlSWLd = 0 ##CHANGE
    
    _structDsg_0 = deepcopy(structDsg_0)
    _formDiag = structDsg_0.formDiag
    
    _fdm = Proxy('compas_ghc.fdm.fdm')
    
    _formData_0 = structDsg_0.formDiag.to_data()
    _formData_1, _cDctFDSolvRes= _fdm.ForceDensitySolver(_formData_0, _flt_TtlSWLd, bool_LdsRdistrByTrib = False, iMax_LdsRedistr = 5)
    _formDiag_1 = FormDiagram.from_data(_formData_1)
    _structDsg_0.SetFormDiagram(_formDiag_1)
    
    formDiag_1  = _formDiag_1
    structDsg_1 = _structDsg_0
    
    fltsL_EdgeForces    = [_x[0] for _x in _cDctFDSolvRes['f']]
    fltsL_EdgeLgths     = [_x[0] for _x in _cDctFDSolvRes['l']]
# ---------- end python ----------
data_2 = Data(python.structDsg_1)
data_3 = Data(python.fltsL_EdgeForces)
data_4 = Data(python.formDiag_1)
data_5 = Data(python.fltsL_EdgeLgths)
structuraldesign_➊ = ClusterOutput(data_2)
lengths_➊ = ClusterOutput(data_5)
forcediagram_➊ = ClusterOutput(data_4)
forces_➊ = ClusterOutput(data_3)

# ==== cluster SpecifyDesign
elements_modifications_instructions = ClusterInput()
formdiagram = ClusterInput()
loads = ClusterInput()
anchor_points = ClusterInput()
data = Data(elements_modifications_instructions)
data_2 = Data(formdiagram)
data_3 = Data(loads)
data_4 = Data(anchor_points)
data_5 = Data(data_3)
python = PythonScript(inp_Dta=data_2)  # -> formDiag, str_InpTyp, strCoordsL; same code as python
python_2 = PythonScript(structLdsL=data_5)  # -> out, strCoordsL_LdsPos, vecsLw_LdsDirMag; inputs structLdsL: list; same code as python_2

# ---- group: !MvToCode
trim = TrimTree(Tree=python.strCoordsL, Depth=1)

# ----
tstat = TreeStatistics(Tree=data_5)  # -> Paths, Length, Count; disabled
panel = Panel(tstat.Paths)  # disabled

data_6 = Data(python.formDiag)
pt = Point(trim)
pt_2 = Point(python_2.strCoordsL_LdsPos)
data_7 = Data(python_2.vecsLw_LdsDirMag)
pt_3 = Point(pt)
pt_4 = Point(pt)
data_8 = Data(data_4)
data_9 = Data(pt_2)
cluster = Cluster_7(data=data_9, pt=pt_4)
cluster_2 = Cluster_7(data=data_8, pt=pt_3)
data_10 = Data(data_6)
int = Integer(cluster_2)
int_2 = Integer(cluster)
data_11 = Data(data_10)
int_3 = Integer(int)
data_12 = Data(data_7)
data_13 = Data(int_2)
data_14 = Data(data)
python_3 = PythonScript(formDiag_0=data_11, vKeysL_Anchs=int_3, vKeysL_LdsPos=data_13, vecsLw_LdsDirMag=data_12, instsElemsAttrsModL=data_14)  # -> out, formDiag_1; inputs vKeysL_Anchs: list of Int32, vKeysL_LdsPos: list of Int32, vecsLw_LdsDirMag: list, instsElemsAttrsModL: list
# ---------- python_3: Python ----------
from compas_ghc.DesignSpecifications import FormDiagramModifications as _FormDiagramModifications
reload(_FormDiagramModifications)

from compas_ghc.utilities.InputsOutputsProcessing import GrasshopperInputsGate
from compas_ghc.utilities.InputsOutputsProcessing import SetDefaultInput as SetDfltInp
from compas_ghc.datastructures.StructuralDesign import StructuralDesign as StructDsg
from compas_ghc.DesignSpecifications.FormDiagramModifications import ImplementElementsModifications as ImplElemsMods

_formDiag_0 =   formDiag_0
_vKeysL_Anchs = vKeysL_Anchs
_vKeysL_LdsPos = vKeysL_LdsPos
_vecsL_LdsDirMag = vecsLw_LdsDirMag[0]
_instsElemsAttrsModL = instsElemsAttrsModL


print (_vecsL_LdsDirMag)

if GrasshopperInputsGate(_formDiag_0, 'FormDiagram'):
    if len(_vKeysL_Anchs) > 0:
        _formDiag_0.set_vertices_attribute('is_anchor', True, _vKeysL_Anchs)

    if len(_vKeysL_LdsPos) > 0:
        zipLdsInfo = zip(_vKeysL_LdsPos, _vecsL_LdsDirMag)
        for __vKey_LdPos, __vec_LdDirMag in zipLdsInfo:
#            print ('loaded vKey: ', __vKey_LdPos, ' with: ', __vec_LdDirMag)
            _formDiag_0.set_vertex_attributes(__vKey_LdPos, ['px','py','pz'],__vec_LdDirMag)
    
    if len (_instsElemsAttrsModL) > 0:
        ImplElemsMods(_formDiag_0, _instsElemsAttrsModL)

    formDiag_1 = _formDiag_0
    
    

#for _vKey, _attr in formDiag_1.vertex.items():
#    print (_vKey, _attr)
# ---------- end python_3 ----------
data_15 = Data(python_3.formDiag_1)
data_16 = Data(data_15)
formdiagram_1 = ClusterOutput(data_16)

# ==== cluster Cluster_10
list_of_elements_keys = ClusterInput()  # If no keys are entered, the attribute value will apply to all elements.
element_type = ClusterInput()  # 'v': vertex, 'e': edge
attribute_name = ClusterInput()  # Input single string/text entry.
attribute_values = ClusterInput()  # Enter one value to be applied to all elements keyed, or enter one value per element keyed.
data = Data(element_type)
data_2 = Data(attribute_name)
data_3 = Data(attribute_values)
data_4 = Data(list_of_elements_keys)
python = PythonScript(char_ElemsTyp=data, str_AttrNm=data_2, keysL_Elems=data_4, dtaL_AttrVals=data_3)  # -> out, instsElemsAttrsMod; inputs keysL_Elems: list, dtaL_AttrVals: list
# ---------- python: Python ----------
from compas_ghc.utilities.InputsOutputsProcessing import GrasshopperInputsGate
from compas_ghc.utilities.InputsOutputsProcessing import SetDefaultInput as SetDfltInp
from compas_ghc.datastructures.StructuralDesign import StructuralDesign as StructDsg

from compas_ghc.datastructures import InstructionsContainer  as _InstructionsContainer 
reload(_InstructionsContainer)

from compas_ghc.datastructures.InstructionsContainer import ElementsAttributesModificationInstructions as ElemsAttrsModInsts

_char_ElemsTyp = char_ElemsTyp
if GrasshopperInputsGate(_char_ElemsTyp, 'str'):
    _instsElemsAttrsMod = ElemsAttrsModInsts(_char_ElemsTyp, str_AttrNm, dtaL_AttrVals, keysL_Elems) 
    
    instsElemsAttrsMod = _instsElemsAttrsMod
# ---------- end python ----------
data_5 = Data(python.instsElemsAttrsMod)
elements_attributes_modification_instruc = ClusterOutput(data_5)

# ==== cluster Cluster_7
data = ClusterInput()
pt = ClusterInput()

# ---- group: Find indices of points
data_2 = Data(data)
python = PythonScript(infoL_Anchs=data_2)  # -> iL_Anchs, rgPtsL_Anchs; inputs infoL_Anchs: list
# ---------- python: Python ----------
iL_Anchs = []
rgPtsL_Anchs = []
for _info_Anch in infoL_Anchs:
    _typ = str(type(_info_Anch))
    print _typ
    if _typ == "<type 'Point3d'>":
        rgPtsL_Anchs.append(_info_Anch)
        
    elif _typ == "<type 'str'>" or _typ == "<type 'str'>":
        try:
            _i = int(_info_Anch)
            iL_Anchs.append(_info_Anch)
        except:
            pass
# ---------- end python ----------
pt_2 = Point(pt)
pt_3 = Point(python.rgPtsL_Anchs)
pt_4 = Point(pt_3)
cp = ClosestPoint(Point=pt_4, Cloud=pt_2)  # -> ClosestPoint, CPIndex, Distance
int = Integer(python.iL_Anchs)
int_2 = Integer(cp.CPIndex)
merge = Merge(Data1=int, Data2=int_2)
cset = CreateSet(List=merge)  # -> Set, Map
int_3 = Integer(cset.Set)

# ----
tstat = TreeStatistics(Tree=pt_2)  # -> Paths, Length, Count; disabled
panel = Panel(tstat.Paths)  # disabled

int_4 = ClusterOutput(int_3)
