# Grasshopper definition TNA_cnpt_mockup.gh (Grasshopper 0.9.76)
# plug-ins: Python Interpreter

python = PythonScript()  # -> form, force
# ---------- python: Python ----------
from compas_tna.diagrams import FormDiagram
from compas_tna.diagrams import ForceDiagram

_form = FormDiagram.from_json('C:/Users/Kam-Ming Mark Tam/Documents/GitHub/AAG2018/AAG2018/src/day_1/final/aag_02_formdiagram.json')
_force = ForceDiagram.from_json('C:/Users/Kam-Ming Mark Tam/Documents/GitHub/AAG2018/AAG2018/src/day_1/final/aag_03_forcediagram.json')

form = _form
force = _force

_form.set_edges_attribute('fmin', 0.2)
_form.set_edges_attribute('fmax', 5.0)
# ---------- end python ----------
data = Data(python.form)

# ---- group: Γ
data_2 = Data(data)

# ----
assemblestructuraldesign = AssembleStructuralDesign(formdiagram=data_2)

# ---- group: Proxy Reset
python_2 = PythonScript()  # -> out, a
# ---------- python_2: Python ----------
from compas.rpc import Proxy
compas_tna = Proxy('compas_ghc.tna')
compas_tna.stop_server()
compas_tna = Proxy('compas_ghc.tna')
# ---------- end python_2 ----------

# ---- group: structDsg
data_3 = Data(assemblestructuraldesign)

# ----
assemblestructuraldesign_2 = AssembleStructuralDesign()

# ---- group: CreateDualDiagram
cluster = Cluster(structuraldesign_0=data_3)  # -> structuraldesign_1, forcediagram_1

# ----
number_slider = Slider(100, range=0..100)
number_slider_2 = Slider(100, range=0..100)

# ---- group: DisassembleStructuralDesign
cluster_2 = Cluster_2()  # -> structuraldesign_1, forcediagram_1

# ---- group: structDsg
data_4 = Data(cluster.structuraldesign_1)

# ----
int = Integer()
int_2 = Integer()

# ---- group: HorizontalEquilibrium
cluster_3 = Cluster_3(structuraldesign_0=data_4, alpha=int_2, maxiterations=int)  # -> structuraldesign_1, formdiagram_1, forcediagram_1

# ----
formdiagram = FormDiagram()
forcediagram = ForceDiagram()
data_5 = Data(forcediagram)
data_6 = Data(data_5)
structuraldesign = StructuralDesign()

# ---- group: CreateDualDiagram
cluster_4 = Cluster_2()  # -> structuraldesign_1, forcediagram_1

# ---- group: structDsg
data_7 = Data(cluster_4.structuraldesign_1)

# ==== cluster AssembleStructuralDesign
formdiagram = ClusterInput()
forcediagram = ClusterInput()
python = PythonScript(formDiag=formdiagram, forceDiag=forcediagram)  # -> structDsg
# ---------- python: Python ----------
#from compas.rpc import Proxy
#reload(compas_ghc.datastructures.StructuralDesign)
from compas_ghc.datastructures.StructuralDesign import StructuralDesign as StructDsg


#if form or force diagrams are valid?
_structDsg = StructDsg()

if formDiag is not None:
    _structDsg.SetFormDiagram(formDiag)
    
if forceDiag is not None:
    _structDsg.SetForceDiagram(forceDiag)
    
structDsg = _structDsg
# ---------- end python ----------
structuraldesign = ClusterOutput(python)

# ==== cluster Cluster
structuraldesign_0 = ClusterInput()
createdualdiagram = PythonScript(structDsg_0=structuraldesign_0)  # -> structDsg_1, forceDiag_1
# ---------- createdualdiagram: Python ----------
#from compas_tna.rhino import DiagramHelper
from compas_tna.diagrams import ForceDiagram

if structDsg_0 is not None:
    _structDsg_0    = structDsg_0
    _formDiag       = _structDsg_0.formDiag
    _forceDiag      = ForceDiagram.from_formdiagram(_formDiag)
    _structDsg_0.SetForceDiagram(_forceDiag)

    structDsg_1 = _structDsg_0
    forceDiag_1 = _forceDiag
# ---------- end createdualdiagram ----------
structuraldesign_1 = ClusterOutput(createdualdiagram.structDsg_1)
forcediagram_1 = ClusterOutput(createdualdiagram.forceDiag_1)

# ==== cluster Cluster_2
structuraldesign_0 = ClusterInput()
createdualdiagram = PythonScript(structDsg_0=structuraldesign_0)  # -> formDiag, forceDiag
# ---------- createdualdiagram: Python ----------
#from compas_tna.rhino import DiagramHelper
from compas_tna.diagrams import ForceDiagram

if structDsg_0 is not None:
    _structDsg_0    = structDsg_0
    
    _formDiag       = _structDsg_0.formDiag
    _forceDiag      = _structDsg_0.forceDiag
    
    
    formDiag        = _formDiag
    forceDiag       = _forceDiag
# ---------- end createdualdiagram ----------
structuraldesign_1 = ClusterOutput(createdualdiagram.formDiag)
forcediagram_1 = ClusterOutput(createdualdiagram.forceDiag)

# ==== cluster Cluster_3
structuraldesign_0 = ClusterInput()
alpha = ClusterInput()  # default: 100
maxiterations = ClusterInput()  # default: 100
data = Data(alpha)
data_2 = Data(maxiterations)
data_3 = Data(structuraldesign_0)
python = PythonScript(structDsg_0=data_3, flt_Alpha=data, int_KMax=data_2)  # -> stuctDsg_1, formDiag_1, forceDiag_1
# ---------- python: Python ----------
from compas_ghc.utilities.InputsOutputsProcessing import GrasshopperInputsGate
from compas_ghc.datastructures.StructuralDesign import StructuralDesign as StructDsg

_structDsg_0 = structDsg_0

if GrasshopperInputsGate(_structDsg_0, 'StructuralDesign'):
    from compas.rpc import Proxy
    _tna = Proxy('compas_ghc.tna')
    
    from copy import deepcopy
    from compas_tna.diagrams import FormDiagram
    from compas_tna.diagrams import ForceDiagram
    
    _formDiag_0, _forceDiag_0 = _structDsg_0.OutputDualDiagrams()
    
    _formData_0 = deepcopy(_formDiag_0.to_data())
    _forceData_0 = deepcopy(_forceDiag_0.to_data())
    
    try:
        _formData_1, _forceData_1, _ = _tna.horizontal_nodal_from_data(_formData_0 , _forceData_0, alpha=100, kmax=100)
        _formDiag_1     = FormDiagram.from_data(_formData_1)
        _forceDiag_1    = ForceDiagram.from_data(_forceData_1)
    
        _structDsg_1    = StructDsg()
        _structDsg_1.SetDualDiagrams(_formDiag, _forceDiag)
        
        formDiag_1      = _formDiag_1
        forceDiag_1     = _froceDiag_1
        structDsg_1     = _structDsg_1
        
    except:
        pass
# ---------- end python ----------
data_4 = Data(python.stuctDsg_1)
data_5 = Data(python.forceDiag_1)
data_6 = Data(python.formDiag_1)
formdiagram_1 = ClusterOutput(data_6)
structuraldesign_1 = ClusterOutput(data_4)
forcediagram_1 = ClusterOutput(data_5)
